# Grasshopper definition 0628_Arch_Assembly.gh (Grasshopper 1.0.7)

height = Slider(0.02, range=0.02..0.1)  # disabled
number_slider = Slider(0.03, range=0.02..0.1)  # disabled
number_slider_2 = Slider(0.06, range=0.02..0.1)  # disabled
part = GhPythonScript(width=number_slider_2, depth=number_slider, height=height)  # -> a, part; disabled
# ---------- part: Python ----------
from compas.geometry import Box
from compas.artists import Artist

part = Box.from_diagonal([(width / -2., depth / -2., 0), (width / 2., depth / 2., height)])
a = Artist(part).draw()
# ---------- end part ----------
number_slider_3 = Slider(0.3, range=0..1)  # disabled
pt = Point([Point(0.3353705841, 0.1154154483, 0), Point(0.3353705841, -0.117717799, 0)])  # disabled
Z = UnitZ(Factor=1)  # disabled
item = ListItem(List=pt, Index=0, Wrap=True)  # -> Item, Item1; disabled
number_slider_4 = Slider(0.1, range=0..0.1)  # disabled
cat = Catenary(PointA=item.Item, PointB=item.Item1, Length=number_slider_3, Gravity=Z)  # disabled
X = UnitX(Factor=number_slider_4)  # disabled
extr = Extrude(Base=cat, Direction=X)  # disabled
X_2 = UnitX(Factor=1)  # disabled
number_slider_5 = Slider(1, range=1..20)  # disabled
contour = Contour(Shape=extr, Point=Point(0, 0, 0), Direction=X_2, Distance=number_slider)  # -> flatten(Contours); disabled
assembly = GhPythonScript(curves=contour, rows=number_slider_5, part_shape=part.part)  # -> frames, curve, bricks, wall; inputs curves: list; disabled
# ---------- assembly: Python ----------
from compas.artists import Artist
from compas.datastructures import Assembly
from compas.datastructures import Part
from compas.geometry import Box
from compas.geometry import Polyhedron
from compas.geometry import Frame
from compas.geometry import Transformation
from compas.geometry import Translation
from compas.geometry import NurbsCurve
from compas_rhino.conversions import RhinoPoint
from compas_rhino.conversions import RhinoCurve

# Create Wall as Assembly instance
wall = Assembly("exercise-wall")

# Create wall curve
curves = [RhinoCurve.from_guid(c).to_compas() for c in curves]
curve = curves[1]

HGAP = 0.005
VGAP = 0.002
divisions = curve.divide_by_length(part_shape.width/2 + HGAP)
ds = []
for i, d in enumerate(divisions):
    if i%2 == 1 and i != len(divisions)-1:
        ds.append(d)
divisions = ds

# Create brick frames
frames = []
key = 0



for div, i in zip(divisions, range(len(divisions))):
    point = curve.point_at(div)
    xaxis = curve.tangent_at(div)
    yaxis = xaxis.cross((0, 0, 1))
    frame = Frame(point, xaxis, yaxis)

    # Create bricks as parts
    width, height, depth = part_shape.width, part_shape.height, part_shape.depth
    brick_type = 'full'
    xoffset = 0

    shape = Box.from_width_height_depth(width, height, depth)
    shape = Polyhedron(*shape.to_vertices_and_faces())

    Tb = Translation.from_vector((xoffset, 0, 0))
    Tf = Transformation.from_frame(frame)
    frame = Frame.from_transformation(Tf * Tb)
    frames.append(frame)

    part = Part(frame=frame, shape=shape)
    wall.add_part(part, key=str(key))
    key += 1


frames = [Artist(f).draw() for f in frames]
curve = Artist(curve).draw()
bricks = [Artist(brick.geometry).draw() for brick in wall.parts()]
# ---------- end assembly ----------
geo = Geometry(assembly.frames)  # disabled
geo_2 = Geometry(assembly.curve)  # disabled
geo_3 = Geometry(assembly.bricks)  # disabled

# ----
# CRA_Analysis & Fabrication
python = GhPythonScript()  # -> out, assembly, frames
# ---------- python: Python ----------
from compas_assembly.geometry import Arch
from compas_cra.datastructures import CRA_Assembly
from compas_assembly.datastructures import Block
from compas.datastructures import Mesh
from compas.geometry import Point, Frame, Vector
from compas.artists import Artist

assembly = CRA_Assembly()
N = 12
arch = Arch(rise = 150/1000, span = 300/1000, thickness = 20/1000, depth = 20/1000, n = N)
frames = []
for i, block in enumerate(arch.blocks()):
    assembly.add_block(Block.from_shape(block), key=i)
    a0 =Point(block.vertex_coordinates(0)[0],block.vertex_coordinates(0)[1],block.vertex_coordinates(0)[2])
    a1 =Point(block.vertex_coordinates(1)[0],block.vertex_coordinates(1)[1],block.vertex_coordinates(1)[2])
    a2 =Point(block.vertex_coordinates(2)[0],block.vertex_coordinates(2)[1],block.vertex_coordinates(2)[2])
    a3 =Point(block.vertex_coordinates(3)[0],block.vertex_coordinates(3)[1],block.vertex_coordinates(3)[2])
    a4 =Point(block.vertex_coordinates(4)[0],block.vertex_coordinates(4)[1],block.vertex_coordinates(4)[2])
    a5 =Point(block.vertex_coordinates(5)[0],block.vertex_coordinates(5)[1],block.vertex_coordinates(5)[2])
    a6 =Point(block.vertex_coordinates(6)[0],block.vertex_coordinates(6)[1],block.vertex_coordinates(6)[2])
    a7 =Point(block.vertex_coordinates(7)[0],block.vertex_coordinates(7)[1],block.vertex_coordinates(7)[2])
    tm = Point((a2 + a3 + a6 + a7)[0]/4,(a2 + a3 + a6 + a7)[1]/4,(a2 + a3 + a6 + a7)[2]/4)
    x = -Vector((a3-a2)[0], (a3-a2)[1] , (a3-a2)[2])
    y = -Vector((a6-a2)[0], (a6-a2)[1] , (a6-a2)[2])
    frames.append(Frame(tm,x,y))



assembly.set_boundary_conditions([0,N-1])
frames = [Artist(f).draw() for f in frames]
# ---------- end python ----------
# 0. Generate Rhino Mesh for Support and Blocks
assembly_visualization = GhPythonScript(assembly=python.assembly)  # -> out, blocks, supports, all
# ---------- assembly_visualization: Python ----------
from compas.datastructures import Mesh
from compas_assembly.datastructures import Block
from compas_cra.datastructures import CRA_Assembly
from compas.artists import Artist
import Rhino.Geometry as rg




def block_to_mesh(block):
    mesh = Mesh()
    for i in block.vertices():
        coor = block.vertex_coordinates(i)
        mesh.add_vertex(key=i, x=coor[0], y=coor[1], z=coor[2])
    
    for i in block.faces():
        mesh.add_face(block.face_vertices(i))
        
    return mesh
    
def draw_blocks(assembly):
    supports = []
    blocks = []
    all = []
    for node in assembly.nodes():
        block = assembly.node_attribute(node, 'block')
        block_mesh = block_to_mesh(block)
        block_rgmesh = Artist(block_mesh)

#        vertexcolor = {vertex: (255, 0, 0) for vertex in block_mesh.vertices_where({'is_anchor': True})}
#        block_rgmesh.draw_vertices(color=vertexcolor)
#        block_rgmesh.draw_edges()
#        Artist.redraw()

        if assembly.node_attribute(node, 'is_support'):
            supports.append(block_rgmesh.draw())
        else:
            blocks.append(block_rgmesh.draw())
        all.append(block_rgmesh.draw())
    return supports, blocks, all

#Artist.clear()

if __name__ == "__main__":
    supports, blocks, all = draw_blocks(assembly)
# ---------- end assembly_visualization ----------
mesh = Mesh(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)
mesh_2 = Mesh([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])
pt_2 = ConstructPoint(XCoordinate=Slider(0.6, range=0..1), YCoordinate=0, ZCoordinate=Slider(0.1, range=0..1))
mesh_3 = Mesh(assembly_visualization.all)
pln = Plane(python.frames)
rotate = Rotate(Geometry=pln, Angle=1.570796327, Plane=PlaneXY(0, 0, 0))  # -> Geometry, Transform
rotate_2 = Rotate(Geometry=mesh_3, Angle=1.570796327, Plane=PlaneXY(0, 0, 0))  # -> Geometry, Transform
# 1. Generate Compas_Geometry
cra_geometry = GhPythonScript(blocks=assembly_visualization.blocks, supports=assembly_visualization.supports)  # -> out, cra_geo; inputs blocks: list of Mesh, supports: list of Mesh
# ---------- cra_geometry: Python ----------
import Rhino.Geometry as rg
from compas.datastructures import Mesh
from compas_rhino.conversions import RhinoMesh


class cra_geometry():
    def __init__(self, rg_blocks, rg_supports):
        compas_blocks = [RhinoMesh.from_geometry(rg_block).to_compas() for rg_block in rg_blocks]
        compas_supports = [RhinoMesh.from_geometry(rg_support).to_compas()  for rg_support in rg_supports]
        self.blocks = compas_blocks
        self.supports = compas_supports
    
    def blocks(self):
        return self.blocks

    def supports(self):
        return self.supports

if __name__ =="__main__":
    cra_geo = cra_geometry(blocks, supports)
# ---------- end cra_geometry ----------
move = Move(Geometry=rotate.Geometry, Motion=pt_2)  # -> Geometry, Transform
# 0. Generate Assembly (part)
move_2 = Move(Geometry=rotate_2.Geometry, Motion=pt_2)  # -> Geometry, Transform
python_2 = GhPythonScript(blocks=move_2.Geometry, frames=move.Geometry)  # -> out, wall, bricks, shapes; inputs blocks: list, frames: list
# ---------- python_2: Python ----------
from compas.datastructures import Assembly
from compas.geometry import Frame
from compas.datastructures import Mesh
from compas.datastructures import Part
from compas_rhino.conversions import RhinoMesh, plane_to_compas_frame
from compas.geometry import Polyhedron
from compas.geometry import Transformation
from compas.artists import Artist
import Rhino.Geometry as rg

wall = Assembly("test")
shapes = []

for i, block in enumerate(blocks):
    
    ######################################################
    # Transform Blocks to Origin
    ######################################################
    
    a = RhinoMesh.from_geometry(block).to_compas()
    shape = Polyhedron(*a.to_vertices_and_faces()) #standard format
    frame = plane_to_compas_frame(frames[i])
    T = Transformation.from_frame_to_frame(frame,Frame([0,0,0], [1,0,0],[0,1,0]))
    #T = Transformation.from_change_of_basis(Frame([0,0,0], [1,0,0],[0,-1,0]), frame)
    print(T)
    shape2 = shape.transformed(T)
    shapes.append(shape2)
    
    ######################################################
    # Create Parts for Fabrication
    ######################################################
    part = Part (frame = frame , shape = shape2)
    wall.add_part(part, key = str(i))
    
bricks = [Artist(brick.geometry).draw() for brick in wall.parts()]
shapes = [Artist(shape).draw() for shape in shapes]
# ---------- end python_2 ----------
mesh_4 = Mesh(python_2.shapes)
mesh_5 = Mesh(python_2.bricks)
# 2. Run CRA_ANALYSIS
python_3 = GhPythonScript(cra_geo=cra_geometry.cra_geo, on=Toggle(False))  # -> out, assembly
# ---------- python_3: Python ----------
import math as mt

from compas.datastructures import Mesh
from compas.geometry import Box
from compas.geometry import Frame
from compas.geometry import Translation
from compas_assembly.datastructures import Block
from compas_cra.datastructures import CRA_Assembly
from compas_cloud import Proxy
#from compas_cra.datastructures import assembly_interfaces_numpy
#from compas_cra.equilibrium import cra_solve, cra_penalty_solve
#from compas_cra.viewers import cra_view

################################################################
#Create Assembly
################################################################
assembly = CRA_Assembly()

for i, block in enumerate(cra_geo.blocks):
    assembly.add_block(Block.from_shape(block), key=i)

support_list = []
for j, support in enumerate(cra_geo.supports):
    assembly.add_block(Block.from_shape(support), key=i + j + 1)
    support_list.append(i+j+1)

assembly.set_boundary_conditions(support_list)

################################################################
#Create Analysis Interfaces
################################################################


proxy = Proxy()
assembly_interfaces_numpy = proxy.function('compas_cra.datastructures.assembly_interfaces_numpy', cache = True)
assembly = assembly_interfaces_numpy(assembly, nmax=10, amin=1e-8, tmax=1e-5)
print(assembly)

################################################################
#Solve and Visualization
################################################################

mu = 0.9
dispbnd = 1e-1
overlap = 1e-3
d = 0.15
if on:
    cra_solve = proxy.function('compas_cra.equilibrium.cra_solve')
    #cra_solve(assembly, verbose=True, timer=True)
    cra_solve(assembly, verbose=True, density=d, d_bnd=dispbnd, eps=overlap, mu=mu)
    #cra_penalty_solve = proxy.function('compas_cra.equilibrium.cra_penalty_solve',cache=True)
    #cra_penalty_solve(assembly, verbose=True, density=d, d_bnd=dispbnd, eps=overlap, mu=mu)

    cra_view = proxy.function('compas_cra.viewers.cra_view')
    cra_view(assembly, resultant=False, nodal=True, grid=True, weights=False,displacements=True, dispscale=1, scale=100000*d)
    #cra_view(assembly, resultant=False, nodal=True, grid=True,
    #         displacements=True, dispscale=10)
# ---------- end python_3 ----------
path = FilePath("C:\Users\jingwen\Downloads\drive-download-20220627T104616Z-001\cra_assembly_result.json")
# 1. Generate Sequence
linear_sequence = GhPythonScript(wall=python_2.wall)  # -> out, assembly
# ---------- linear_sequence: Python ----------
import compas
from compas.utilities import pairwise

assembly = wall

# Define connectivity as a linear sequence of integers
linear_sequence = sorted(assembly.parts(), key=lambda p: int(p.key))
for a, b in pairwise(linear_sequence):
    assembly.add_connection(a, b)

print([part.key for part in linear_sequence])
# ---------- end linear_sequence ----------
path_2 = FilePath("C:\Users\jingwen\Downloads\drive-download-20220627T104616Z-001\arch_assembly.json")
to_json = ToJSON(data=python_3.assembly, filepath=path, pretty=Toggle(False))  # -> json; inputs pretty: Boolean
#   port data: COMPAS data objects to serialize.
#   port filepath: File path where to store the JSON file. If empty, it will not store to disk but instead return the JSON string.
#   port pretty: If True, JSON data will be formatted with indentation and key sorting.
#   port json: JSON file path or JSON string.
# ---------- to_json: Python ----------
"""
Serializes COMPAS objects to JSON.
"""
from ghpythonlib.componentbase import executingcomponent as component

import compas


class CompasInfo(component):
    def RunScript(self, data, filepath, pretty):
        json = filepath

        if filepath:
            compas.json_dump(data, filepath, pretty)
        else:
            json = compas.json_dumps(data, pretty)

        return json
# ---------- end to_json ----------
to_json_2 = ToJSON(data=linear_sequence.assembly, filepath=path_2, pretty=Toggle(False))  # -> json; inputs pretty: Boolean; same code as to_json
# 3. Result Visualization (need to be imporved)
assembly_visualization_2 = GhPythonScript(assembly=python_3.assembly)  # -> out, blocks, supports
# ---------- assembly_visualization_2: Python ----------
from compas.datastructures import Mesh
from compas_assembly.datastructures import Block
from compas_cra.datastructures import CRA_Assembly
from compas.artists import Artist
import Rhino.Geometry as rg




def block_to_mesh(block):
    mesh = Mesh()
    for i in block.vertices():
        coor = block.vertex_coordinates(i)
        mesh.add_vertex(key=i, x=coor[0], y=coor[1], z=coor[2])
    
    for i in block.faces():
        mesh.add_face(block.face_vertices(i))
        
    return mesh
    
def draw_blocks(assembly):
    supports = []
    blocks = []
    for node in assembly.nodes():
        block = assembly.node_attribute(node, 'block')
        block_mesh = block_to_mesh(block)
        block_rgmesh = Artist(block_mesh)

#        vertexcolor = {vertex: (255, 0, 0) for vertex in block_mesh.vertices_where({'is_anchor': True})}
#        block_rgmesh.draw_vertices(color=vertexcolor)
#        block_rgmesh.draw_edges()
#        Artist.redraw()

        if assembly.node_attribute(node, 'is_support'):
            supports.append(block_rgmesh.draw())
        else:
            blocks.append(block_rgmesh.draw())
    return supports, blocks

#Artist.clear()

if __name__ == "__main__":
    supports, blocks = draw_blocks(assembly)
# ---------- end assembly_visualization_2 ----------
# 2. Motion Planning
motion_planning = GhPythonScript(assembly=linear_sequence.assembly)  # -> out, assembly
# ---------- motion_planning: Python ----------
import math
import os
from compas_fab.backends import RosClient
from compas_fab.robots import AttachedCollisionMesh
from compas_fab.robots import CollisionMesh
from compas_fab.robots import PlanningScene
from compas_fab.robots import Tool
from compas.geometry import Transformation

import compas
from compas.datastructures import Mesh
from compas.geometry import Box
from compas.geometry import Frame
from compas.geometry import Vector
from compas.geometry import Translation
from compas.topology import breadth_first_ordering
import Grasshopper as gh
from compas.artists import Artist


assembly = assembly


def get_tool():
    current_folder =os.path.dirname(ghdoc.Path)
    mesh = Mesh.from_stl(os.path.join(current_folder, "vacuum_suction_simplified.stl"))
    #mesh = Mesh.from_stl("vacuum_suction_simplified.stl")#0.078
    #mesh = Mesh.from_stl("vacuum_gripper_simplified.stl")#0.064
    frame = Frame([0, 0, 0.078], [1, 0, 0], [0, 1, 0])
    tool = Tool(mesh, frame, link_name="wrist_3_link")
    return tool


def get_approach_vector(part_key):
    part = assembly.graph.node_attribute(part_key, "part")
    approach_vector = part.frame.zaxis.scaled(-0.05)
    return approach_vector


def get_pick_frame(part_key):
    return Frame((0.3, 0.1, 0.020), (-1, 0, 0), (0, 1, 0))


def get_place_frame(part_key):
    part = assembly.graph.node_attribute(part_key, "part")
    return part.frame


def prepare_scene(robot, part_key):
    scene = PlanningScene(robot)
    box = Box.from_diagonal([(-0.7, -0.7, 0), (0.7, 0.7, -0.02)])
    mesh = Mesh.from_shape(box)
    scene.add_collision_mesh(CollisionMesh(mesh, "floor"))

    for k in get_part_sequence():
        if part_key == k:
            break

        part = assembly.graph.node_attribute(k, "part")
        mesh = Mesh.from_shape(part.shape)
        scene.append_collision_mesh(CollisionMesh(mesh, "brick_wall", frame=part.frame))
        t = Transformation.from_frame_to_frame(Frame([0,0,0],[1,0,0],[0,1,0]),part.frame)
        aaaa = CollisionMesh(mesh, "brick_wall", frame=part.frame).mesh.transformed(t)
        check_mesh.append(aaaa)


def get_start_configuration(robot):
    config = robot.zero_configuration()
    config.joint_values = (-0.306, 4.351, 2.231, -2.869, 4.712, 1.465)
    return config


def get_part_shape(part_key):
    part = assembly.graph.node_attribute(part_key, "part")
    return part.shape


def get_part_sequence():
    root_part_key = "0"
    sequence = breadth_first_ordering(assembly.graph.adjacency, root_part_key)
    return sequence


def get_tolerance_joints():
    return [math.radians(1)] * 6


def get_planner_id():
    return "TRRT"


# PICK & PLACE PROCEDURE

def adjust_to_attached_tool(robot, frame):
    if not robot.attached_tool:
        return frame
    return robot.from_tcf_to_t0cf([frame])[0]


client = RosClient("localhost")
client.run()

robot = client.load_robot()

start_configuration = get_start_configuration(robot)

tool = get_tool()
if tool:
    robot.attach_tool(tool)

assembly.attributes['start_configuration'] = start_configuration.data
assembly.attributes['tool'] = tool.data
check_mesh = []
#for part_key in get_part_sequence():
for part_key in get_part_sequence()[0:11]:   # NOTE: For quick testing, only take the first few parts in the sequence
    part = assembly.graph.node_attribute(part_key, "part")

    scene = PlanningScene(robot)
    scene.reset()
    prepare_scene(robot, part_key)

    print("Part {}\n--------".format(part_key))
    print(" [  ] Pick frame + approach vector reachability\r")
    pick_frame = adjust_to_attached_tool(robot, get_pick_frame(part_key))
    approach_pick_frame = pick_frame.transformed(
        Translation.from_vector(get_approach_vector(part_key))
    )

    approach_pick_config = robot.inverse_kinematics(
        approach_pick_frame, start_configuration
    )
    part.attributes["approach_pick_config"] = approach_pick_config
    print(" [OK]")

    print(" [  ] Pick frame\r")
    pick_config = robot.inverse_kinematics(pick_frame, approach_pick_config)
    part.attributes["pick_config"] = pick_config
    print(" [OK]")

    print(" [  ] Place frame + approach vector\r")
    place_frame = adjust_to_attached_tool(robot, get_place_frame(part_key))
    approach_place_frame = place_frame.transformed(
        Translation.from_vector(get_approach_vector(part_key))
    )

    # we use the approach pick config as start, because we estimate is the closest
    approach_place_config = robot.inverse_kinematics(
        approach_place_frame, approach_pick_config
    )
    part.attributes["approach_place_config"] = approach_place_config
    print(" [OK]")

    print(" [  ] Place frame\r")
    place_config = robot.inverse_kinematics(place_frame, approach_place_config)
    part.attributes["place_config"] = place_config
    print(" [OK]")

    print(" [  ] Pick path (before)\r")
    frames = [approach_pick_frame, pick_frame]
    pick_trajectory = robot.plan_cartesian_motion(
        frames,
        approach_pick_config,
        options=dict(
            max_step=0.01,
            avoid_collisions=True,
        ),
    )

    if pick_trajectory.fraction < 1.0:
        raise Exception("Found a pick trajectory but it is not complete")

    print(" [OK]")
    part.attributes["pick_trajectory"] = pick_trajectory

    print(" [  ] Pick path (after)\r")
    frames = [pick_frame, approach_pick_frame]

    # Create ACM with shape
    part_shape = get_part_shape(part_key)
    part_mesh = Mesh.from_shape(part_shape)
    

    ee_link_name = robot.attached_tool.link_name
    attach_frame = robot.attached_tool.frame.copy()
    
    ##Updated based on pickup and place algorithm
    print("a",attach_frame)
    attach_frame.xaxis.x *= -1
    #attach_frame.yaxis.y *= -1
    print("a1",attach_frame)
    t = Transformation.from_frame_to_frame(Frame([0,0,0],[1,0,0],[0,1,0]),Frame([0,0,0],[-1,0,0],[0,1,0]))
    part_mesh_t = part_mesh.transformed(t)
    
    part_acms = [AttachedCollisionMesh(CollisionMesh(part_mesh_t, 'brick', attach_frame), ee_link_name)]
    ##Updated based on pickup and place algorithm
    
    
    pick_trajectory_after = robot.plan_cartesian_motion(
        frames,
        pick_trajectory.points[-1],
        options=dict(
            max_step=0.01,
            avoid_collisions=True,
            attached_collision_meshes=part_acms,
        ),
    )

    if pick_trajectory_after.fraction < 1.0:
        raise Exception("Found a pick trajectory (after) but it is not complete")

    print(" [OK]")
    part.attributes["pick_trajectory_after"] = pick_trajectory_after

    print(" [  ] Place path (before)\r")
    frames = [approach_place_frame, place_frame]
    place_trajectory = robot.plan_cartesian_motion(
        frames,
        approach_place_config,
        options=dict(
            max_step=0.01,
            avoid_collisions=True,
            attached_collision_meshes=part_acms,
        ),
    )

    if pick_trajectory.fraction < 1.0:
        raise Exception("Found a place trajectory but it is not complete")

    print(" [OK]")
    part.attributes["place_trajectory"] = place_trajectory

    print(" [  ] Place path (after)\r")
    frames = [place_frame, approach_place_frame]
    place_trajectory_after = robot.plan_cartesian_motion(
        frames,
        place_trajectory.points[-1],
        options=dict(
            max_step=0.01,
            avoid_collisions=True,
        ),
    )

    if place_trajectory_after.fraction < 1.0:
        raise Exception("Found a place trajectory (after) but it is not complete")

    print(" [OK]")
    part.attributes["place_trajectory_after"] = place_trajectory_after

    print(" [  ] Free space path\r")
    goal_constraints = robot.constraints_from_configuration(
        approach_place_config,
        tolerances_above=get_tolerance_joints(),
        tolerances_below=get_tolerance_joints(),
    )

    freespace_trajectory = robot.plan_motion(
        goal_constraints,
        approach_pick_config,
        options=dict(
            planner_id=get_planner_id(),
            attached_collision_meshes=part_acms,
        ),
    )
    print(" [OK]")
    part.attributes["freespace_trajectory"] = freespace_trajectory

    print(" [  ] Start config path\r")
    goal_constraints = robot.constraints_from_configuration(
        approach_pick_config,
        tolerances_above=get_tolerance_joints(),
        tolerances_below=get_tolerance_joints(),
    )

    start_trajectory = robot.plan_motion(
        goal_constraints, start_configuration, options=dict(planner_id=get_planner_id())
    )
    print(" [OK]")
    part.attributes["start_trajectory"] = start_trajectory
    print()


scene = PlanningScene(robot)
scene.remove_collision_mesh("brick_wall")

client.close()
#
#compas.json_dump(
#    assembly,
#    os.path.join(HERE, "603_assembly_planning.json"),
#    pretty=True,
#)
#shapes = [Artist(mesh).draw() for mesh in check_mesh]
# ---------- end motion_planning ----------

linear_sequence_2 = GhPythonScript(wall=assembly.wall)  # -> out, assembly; disabled; same code as linear_sequence
motion_planning_2 = GhPythonScript(assembly=linear_sequence_2.assembly)  # -> out, assembly; disabled
# ---------- motion_planning_2: Python ----------
import math
import os
from compas_fab.backends import RosClient
from compas_fab.robots import AttachedCollisionMesh
from compas_fab.robots import CollisionMesh
from compas_fab.robots import PlanningScene
from compas_fab.robots import Tool

import compas
from compas.datastructures import Mesh
from compas.geometry import Box
from compas.geometry import Frame
from compas.geometry import Translation
from compas.topology import breadth_first_ordering
import Grasshopper as gh


assembly = assembly


def get_tool():
    current_folder =os.path.dirname(ghdoc.Path)
    mesh = Mesh.from_stl(os.path.join(current_folder, "vacuum_gripper_simplified.stl"))
    #mesh = Mesh.from_stl("vacuum_suction_simplified.stl")#0.088
    #mesh = Mesh.from_stl("vacuum_gripper_simplified.stl")#0.064
    frame = Frame([0, 0, 0.064], [1, 0, 0], [0, 1, 0])
    tool = Tool(mesh, frame, link_name="wrist_3_link")
    return tool


def get_approach_vector(part_key):
    return (0, 0, 0.05)


def get_pick_frame(part_key):
    return Frame((0.3, 0.1, 0.02), (-1, 0, 0), (0, 1, 0))


def get_place_frame(part_key):
    part = assembly.graph.node_attribute(part_key, "part")
    return part.frame


def prepare_scene(robot, part_key):
    scene = PlanningScene(robot)
    box = Box.from_diagonal([(-0.7, -0.7, 0), (0.7, 0.7, -0.02)])
    mesh = Mesh.from_shape(box)
    scene.add_collision_mesh(CollisionMesh(mesh, "floor"))

    for k in get_part_sequence():
        if part_key == k:
            break

        part = assembly.graph.node_attribute(k, "part")
        mesh = Mesh.from_shape(part.shape)
        scene.append_collision_mesh(CollisionMesh(mesh, "brick_wall", frame=part.frame))


def get_start_configuration(robot):
    config = robot.zero_configuration()
    config.joint_values = (-0.306, 4.351, 2.231, -2.869, 4.712, 1.465)
    return config


def get_part_shape(part_key):
    part = assembly.graph.node_attribute(part_key, "part")
    return part.shape


def get_part_sequence():
    root_part_key = "0"
    sequence = breadth_first_ordering(assembly.graph.adjacency, root_part_key)
    return sequence


def get_tolerance_joints():
    return [math.radians(1)] * 6


def get_planner_id():
    return "TRRT"


# PICK & PLACE PROCEDURE

def adjust_to_attached_tool(robot, frame):
    if not robot.attached_tool:
        return frame
    return robot.from_tcf_to_t0cf([frame])[0]


client = RosClient("localhost")
client.run()

robot = client.load_robot()

start_configuration = get_start_configuration(robot)

tool = get_tool()
if tool:
    robot.attach_tool(tool)

assembly.attributes['start_configuration'] = start_configuration.data
assembly.attributes['tool'] = tool.data

#for part_key in get_part_sequence():
for part_key in get_part_sequence():   # NOTE: For quick testing, only take the first few parts in the sequence
    part = assembly.graph.node_attribute(part_key, "part")

    scene = PlanningScene(robot)
    scene.reset()
    prepare_scene(robot, part_key)

    print("Part {}\n--------".format(part_key))
    print(" [  ] Pick frame + approach vector reachability\r")
    pick_frame = adjust_to_attached_tool(robot, get_pick_frame(part_key))
    approach_pick_frame = pick_frame.transformed(
        Translation.from_vector(get_approach_vector(part_key))
    )

    approach_pick_config = robot.inverse_kinematics(
        approach_pick_frame, start_configuration
    )
    part.attributes["approach_pick_config"] = approach_pick_config
    print(" [OK]")

    print(" [  ] Pick frame\r")
    pick_config = robot.inverse_kinematics(pick_frame, approach_pick_config)
    part.attributes["pick_config"] = pick_config
    print(" [OK]")

    print(" [  ] Place frame + approach vector\r")
    place_frame = adjust_to_attached_tool(robot, get_place_frame(part_key))
    approach_place_frame = place_frame.transformed(
        Translation.from_vector(get_approach_vector(part_key))
    )

    # we use the approach pick config as start, because we estimate is the closest
    approach_place_config = robot.inverse_kinematics(
        approach_place_frame, approach_pick_config
    )
    part.attributes["approach_place_config"] = approach_place_config
    print(" [OK]")

    print(" [  ] Place frame\r")
    place_config = robot.inverse_kinematics(place_frame, approach_place_config)
    part.attributes["place_config"] = place_config
    print(" [OK]")

    print(" [  ] Pick path (before)\r")
    frames = [approach_pick_frame, pick_frame]
    pick_trajectory = robot.plan_cartesian_motion(
        frames,
        approach_pick_config,
        options=dict(
            max_step=0.01,
            avoid_collisions=True,
        ),
    )

    if pick_trajectory.fraction < 1.0:
        raise Exception("Found a pick trajectory but it is not complete")

    print(" [OK]")
    part.attributes["pick_trajectory"] = pick_trajectory

    print(" [  ] Pick path (after)\r")
    frames = [pick_frame, approach_pick_frame]

    # Create ACM with shape
    part_shape = get_part_shape(part_key)
    part_mesh = Mesh.from_shape(part_shape)

    ee_link_name = robot.attached_tool.link_name
    attach_frame = robot.attached_tool.frame.copy()
    attach_frame.xaxis.x *= -1
    part_acms = [AttachedCollisionMesh(CollisionMesh(part_mesh, 'brick', attach_frame), ee_link_name)]

    pick_trajectory_after = robot.plan_cartesian_motion(
        frames,
        pick_trajectory.points[-1],
        options=dict(
            max_step=0.01,
            avoid_collisions=True,
            attached_collision_meshes=part_acms,
        ),
    )

    if pick_trajectory_after.fraction < 1.0:
        raise Exception("Found a pick trajectory (after) but it is not complete")

    print(" [OK]")
    part.attributes["pick_trajectory_after"] = pick_trajectory_after

    print(" [  ] Place path (before)\r")
    frames = [approach_place_frame, place_frame]
    place_trajectory = robot.plan_cartesian_motion(
        frames,
        approach_place_config,
        options=dict(
            max_step=0.01,
            avoid_collisions=True,
            attached_collision_meshes=part_acms,
        ),
    )

    if pick_trajectory.fraction < 1.0:
        raise Exception("Found a place trajectory but it is not complete")

    print(" [OK]")
    part.attributes["place_trajectory"] = place_trajectory

    print(" [  ] Place path (after)\r")
    frames = [place_frame, approach_place_frame]
    place_trajectory_after = robot.plan_cartesian_motion(
        frames,
        place_trajectory.points[-1],
        options=dict(
            max_step=0.01,
            avoid_collisions=True,
        ),
    )

    if place_trajectory_after.fraction < 1.0:
        raise Exception("Found a place trajectory (after) but it is not complete")

    print(" [OK]")
    part.attributes["place_trajectory_after"] = place_trajectory_after

    print(" [  ] Free space path\r")
    goal_constraints = robot.constraints_from_configuration(
        approach_place_config,
        tolerances_above=get_tolerance_joints(),
        tolerances_below=get_tolerance_joints(),
    )

    freespace_trajectory = robot.plan_motion(
        goal_constraints,
        approach_pick_config,
        options=dict(
            planner_id=get_planner_id(),
            attached_collision_meshes=part_acms,
        ),
    )
    print(" [OK]")
    part.attributes["freespace_trajectory"] = freespace_trajectory

    print(" [  ] Start config path\r")
    goal_constraints = robot.constraints_from_configuration(
        approach_pick_config,
        tolerances_above=get_tolerance_joints(),
        tolerances_below=get_tolerance_joints(),
    )

    start_trajectory = robot.plan_motion(
        goal_constraints, start_configuration, options=dict(planner_id=get_planner_id())
    )
    print(" [OK]")
    part.attributes["start_trajectory"] = start_trajectory
    print()


scene = PlanningScene(robot)
scene.remove_collision_mesh("brick_wall")

client.close()
#
#compas.json_dump(
#    assembly,
#    os.path.join(HERE, "603_assembly_planning.json"),
#    pretty=True,
#)
# ---------- end motion_planning_2 ----------

mesh_6 = Mesh(assembly_visualization_2.blocks)
mesh_7 = Mesh(assembly_visualization_2.supports)
demesh = DeconstructMesh(Mesh=mesh_6)  # -> Vertices, Faces, Colours, Normals
demesh_2 = DeconstructMesh(Mesh=mesh_7)  # -> Vertices, Faces, Colours, Normals
conmesh = ConstructMesh(Vertices=demesh.Vertices, Faces=demesh.Faces)
conmesh_2 = ConstructMesh(Vertices=demesh_2.Vertices, Faces=demesh_2.Faces)
connect = BooleanToggle(True)
preview = CustomPreview(Geometry=conmesh, Material=ColourSwatch(SwatchColor=RGBA(75, 189, 170, 130)))
preview_2 = CustomPreview(Geometry=conmesh_2, Material=ColourSwatch(SwatchColor=RGBA(37, 105, 232, 144)))
number_slider_6 = Slider(10, range=0..100)
ros = ROSConnect(connect=connect)  # -> ros_client, is_connected; inputs port: Int32, connect: Boolean
#   port ip: The ip address ROS. Defaults to 127.0.0.1.
#   port port: The port of ROS. Defaults to 9090.
#   port connect: If True, connects to ROS. If False, disconnects from ROS. Defaults to False.
#   port ros_client: The ROS client.
#   port is_connected: True if connection established.
# ---------- ros: Python ----------
"""
Connect or disconnect to ROS.

COMPAS FAB v0.22.0
"""
from ghpythonlib.componentbase import executingcomponent as component
from scriptcontext import sticky as st

from compas_fab.backends import RosClient
from compas_fab.ghpython.components import create_id


class ROSConnect(component):
    def RunScript(self, ip, port, connect):
        ros_client = None

        ip = ip or '127.0.0.1'
        port = port or 9090

        key = create_id(self, 'ros_client')
        ros_client = st.get(key, None)

        if ros_client:
            st[key].close()
        if connect:
            st[key] = RosClient(ip, port)
            st[key].run(5)

        ros_client = st.get(key, None)
        is_connected = ros_client.is_connected if ros_client else False
        return (ros_client, is_connected)
# ---------- end ros ----------

connect_2 = BooleanToggle(True)  # disabled
ros_2 = ROSConnect(connect=connect_2)  # -> ros_client, is_connected; inputs port: Int32, connect: Boolean; disabled; same code as ros
load_robot = BooleanToggle(True)  # disabled
robot = ROSRobot(ros_client=ros_2.ros_client, load=load_robot)  # -> robot; inputs load: Boolean; disabled
#   port ros_client: The ROS client.
#   port load: If True, loads the robot from ROS. Defaults to False.
# ---------- robot: Python ----------
"""
Load robot directly from ROS.

COMPAS FAB v0.22.0
"""
from compas_ghpython.artists import RobotModelArtist
from ghpythonlib.componentbase import executingcomponent as component
from scriptcontext import sticky as st

from compas_fab.ghpython.components import create_id


class ROSRobot(component):
    def RunScript(self, ros_client, load):
        key = create_id(self, 'robot')

        if ros_client and ros_client.is_connected and load:
            # Load URDF from ROS
            st[key] = ros_client.load_robot(load_geometry=True, precision='12f')
            st[key].artist = RobotModelArtist(st[key].model)

        robot = st.get(key, None)
        if robot:  # client sometimes need to be restarted, without needing to reload geometry
            robot.client = ros_client
        return robot
# ---------- end robot ----------

button = Button()  # disabled
number_slider_7 = Slider(3, range=0..100)  # disabled
number_slider_8 = Slider(32, range=0..100)  # disabled
load = GhPythonScript(assembly=motion_planning_2.assembly, robot=robot, reload=button)  # -> robot, assembly; disabled
# ---------- load: Python ----------
import compas
from compas_fab.robots import Tool

if 'tool' in assembly.attributes:
    tool = Tool.from_data(assembly.attributes['tool'])
    robot.attach_tool(tool)
# ---------- end load ----------
load_plans = GhPythonScript(assembly=load.assembly, part=number_slider_7, i=number_slider_8)  # -> total, config, acms; disabled
# ---------- load_plans: Python ----------
trajectory_keys = ("start_trajectory",
                   "pick_trajectory",
                   "pick_trajectory_after",
                   "freespace_trajectory",
                   "place_trajectory",
                   "place_trajectory_after",)

# NOTE: Replace this with assembly.find_by_key after this is merged:
# https://github.com/compas-dev/compas/pull/1032
part = assembly.graph.node_attribute(str(int(part)), "part")

lbound = 0
ubound = 0
i = int(i)
total = sum([len(part.attributes[traj_name].points) for traj_name in trajectory_keys])
if i >= total:
    raise Exception('Max number of trajectory points is ' + str(total))
    
for traj_name in trajectory_keys:
    traj = part.attributes[traj_name]
    ubound += len(traj.points)

    if i >= ubound:
        lbound = ubound
        continue

    config = traj.points[i - lbound]
    acms = traj.attached_collision_meshes
    break
# ---------- end load_plans ----------

load_robot_2 = BooleanToggle(True)
# 3. UR Robot Visualization
robot_2 = ROSRobot(ros_client=ros.ros_client, load=load_robot_2)  # -> robot; inputs load: Boolean; same code as robot
load_2 = GhPythonScript(assembly=motion_planning.assembly, robot=robot_2, reload=Button())  # -> robot, assembly; same code as load
load_plans_2 = GhPythonScript(assembly=load_2.assembly, part=number_slider_6, i=Slider(0, range=0..100))  # -> total, config, acms; same code as load_plans
refresh = Button()
robot_visualize = RobotVisualize(
    robot=load_2.robot,
    configuration=load_plans_2.config,
    attached_collision_meshes=load_plans_2.acms,
    show_frames=True,
    show_acm=True)  # -> visual, collision, attached_meshes, frames, base_frame, ee_frame; inputs attached_collision_meshes: list, show_visual: Boolean, show_collision: Boolean, show_frames: Boolean, show_base_frame: Boolean, show_end_effector_frame: Boolean, show_acm: Boolean
#   port group: The planning group used for end-effector and base visualization.
#   port configuration: The robot's full configuration.
#   port attached_collision_meshes: A list of attached collision meshes.
#   port show_visual: Whether or not to show the robot's visual meshes.
#   port show_collision: Whether or not to show the robot's collision meshes.
#   port show_frames: Whether or not to show the robot's joint frames.
#   port show_base_frame: Whether or not to show the robot's base frame.
#   port show_end_effector_frame: Whether or not to show the robot's end-effector frame.
#   port show_acm: Whether or not to show the attached collision meshes (if any).
#   port visual: The robot's visual Rhino meshes (if any).
#   port collision: The robot's collision Rhino meshes (if any).
#   port attached_meshes: The attached collision Rhino meshes (if any).
#   port frames: The robot's joint frames as Rhino planes (if any).
#   port base_frame: The robot's base frame as a Rhino plane (if any).
#   port ee_frame: The robot's end-effector frame as a Rhino plane (if any).
# ---------- robot_visualize: Python ----------
"""
Visualizes the robot.

COMPAS FAB v0.22.0
"""
from compas.geometry import Transformation
from compas_ghpython.artists import FrameArtist
from compas_ghpython.artists import MeshArtist
from ghpythonlib.componentbase import executingcomponent as component


class RobotVisualize(component):
    def RunScript(self, robot, group, configuration, attached_collision_meshes, show_visual, show_collision,
                  show_frames, show_base_frame, show_end_effector_frame, show_acm):

        visual = None
        collision = None
        attached_meshes = None
        frames = None
        base_frame = None
        ee_frame = None

        if robot:
            show_visual = True if show_visual is None else show_visual
            configuration = configuration or robot.zero_configuration()

            robot.update(configuration, visual=show_visual, collision=show_collision)
            compas_frames = robot.transformed_frames(configuration, group)

            if show_visual:
                visual = robot.artist.draw_visual()

            if show_collision:
                collision = robot.artist.draw_collision()

            if show_base_frame:
                base_compas_frame = compas_frames[0]
                artist = FrameArtist(base_compas_frame)
                base_frame = artist.draw()

            if show_end_effector_frame:
                ee_compas_frame = robot.forward_kinematics(configuration, group, options=dict(solver='model'))
                artist = FrameArtist(ee_compas_frame)
                ee_frame = artist.draw()

            if show_frames:
                frames = []
                for compas_frame in compas_frames[1:]:
                    artist = FrameArtist(compas_frame)
                    frame = artist.draw()
                    frames.append(frame)

            if show_acm:
                attached_meshes = []
                for acm in attached_collision_meshes:
                    frame = robot.forward_kinematics(configuration, options=dict(solver='model', link=acm.link_name))
                    T = Transformation.from_frame_to_frame(acm.collision_mesh.frame, frame)
                    mesh = acm.collision_mesh.mesh.transformed(T)
                    attached_meshes.append(MeshArtist(mesh).draw())

        return (visual, collision, attached_meshes, frames, base_frame, ee_frame)
# ---------- end robot_visualize ----------
built_assembly = GhPythonScript(assembly=load_2.assembly, current_part=number_slider_6, only_until_current=Toggle(True))  # -> a
# ---------- built_assembly: Python ----------
from compas.artists import Artist
from compas.topology import breadth_first_ordering

a = []

root_part_key = "0"
sequence = breadth_first_ordering(assembly.graph.adjacency, root_part_key)
current_part = str(int(current_part))

for part_key in sequence:
    part = assembly.graph.node_attribute(part_key, "part")
    if only_until_current and str(part_key) == current_part:
        break
    mesh = part.geometry
    artist = Artist(mesh)
    a.append(artist.draw())
# ---------- end built_assembly ----------
planning_scene = GhPythonScript(robot=load_2.robot, refresh=refresh)  # -> a
# ---------- planning_scene: Python ----------
from compas_fab.robots import PlanningScene

from compas.artists import Artist
from compas.geometry import Frame
from compas.geometry import Transformation


scene = PlanningScene(robot)

collision_meshes = []
attached_collision_meshes = []

configuration = robot.zero_configuration()
scene = robot.client.get_planning_scene()

for co in scene.world.collision_objects:
    header = co.header
    frame_id = header.frame_id
    cms = co.to_collision_meshes()

    for cm in cms:
        if cm.frame != Frame.worldXY():
            t = Transformation.from_frame(cm.frame)
            mesh = cm.mesh.transformed(t)
        else:
            mesh = cm.mesh

        collision_meshes.append(mesh)

    for aco in scene.robot_state.attached_collision_objects:
        for acm in aco.to_attached_collision_meshes():
            frame_id = aco.object["header"]["frame_id"]
            frame = robot.forward_kinematics(configuration, options=dict(link=frame_id))
            t = Transformation.from_frame(frame)

            # Local CM frame
            if (acm.collision_mesh.frame and acm.collision_mesh.frame != Frame.worldXY()):
                t = t * Transformation.from_frame(acm.collision_mesh.frame)

            mesh = acm.collision_mesh.mesh.transformed(t)

            attached_collision_meshes.append(mesh)

a = []
for cm in collision_meshes + attached_collision_meshes:
    a.append(Artist(cm).draw_mesh())
# ---------- end planning_scene ----------

toggle = BooleanToggle(True)  # disabled
refresh_2 = Button()  # disabled
robot_visualize_2 = RobotVisualize(
    robot=load.robot,
    configuration=load_plans.config,
    attached_collision_meshes=load_plans.acms,
    show_frames=True,
    show_acm=True)  # -> visual, collision, attached_meshes, frames, base_frame, ee_frame; inputs attached_collision_meshes: list, show_visual: Boolean, show_collision: Boolean, show_frames: Boolean, show_base_frame: Boolean, show_end_effector_frame: Boolean, show_acm: Boolean; disabled; same code as robot_visualize
built_assembly_2 = GhPythonScript(assembly=load.assembly, current_part=number_slider_7, only_until_current=toggle)  # -> a; disabled; same code as built_assembly
planning_scene_2 = GhPythonScript(robot=load.robot, refresh=refresh_2)  # -> a; disabled; same code as planning_scene

geo_4 = Geometry(robot_visualize.attached_meshes)
geo_5 = Geometry(robot_visualize.collision)
geo_6 = Geometry(robot_visualize.visual)
geo_7 = Geometry(built_assembly)
geo_8 = Geometry(robot_visualize_2.attached_meshes)  # disabled
geo_9 = Geometry(robot_visualize_2.visual)  # disabled
geo_10 = Geometry(built_assembly_2)  # disabled
