# Grasshopper definition 0711_Dual_Assembly_Demonstrator01.gh (Grasshopper 1.0.7)
# plug-ins: Pufferfish, Aggregations

# ----
# 1 Point
pt = Point(Point(0.3727174762, -0.141569116, 0.05481222491))
py = GhPythonScript(pt=pt)  # -> point
# ---------- py: Python ----------
from compas.geometry import Point

point = Point(pt.X, pt.Y, pt.Z)
# ---------- end py ----------

python = GhPythonScript()  # -> out, assembly, frames
# ---------- python: Python ----------
from compas_assembly.geometry import Arch
from compas_cra.datastructures import CRA_Assembly
from compas_assembly.datastructures import Block
from compas.datastructures import Mesh
from compas.geometry import Point, Frame, Vector
from compas.artists import Artist

assembly = CRA_Assembly()
N = 12
arch = Arch(rise = 150/1000, span = 300/1000, thickness = 20/1000, depth = 20/1000, n = N)
frames = []
for i, block in enumerate(arch.blocks()):
    assembly.add_block(Block.from_shape(block), key=i)
    a0 =Point(block.vertex_coordinates(0)[0],block.vertex_coordinates(0)[1],block.vertex_coordinates(0)[2])
    a1 =Point(block.vertex_coordinates(1)[0],block.vertex_coordinates(1)[1],block.vertex_coordinates(1)[2])
    a2 =Point(block.vertex_coordinates(2)[0],block.vertex_coordinates(2)[1],block.vertex_coordinates(2)[2])
    a3 =Point(block.vertex_coordinates(3)[0],block.vertex_coordinates(3)[1],block.vertex_coordinates(3)[2])
    a4 =Point(block.vertex_coordinates(4)[0],block.vertex_coordinates(4)[1],block.vertex_coordinates(4)[2])
    a5 =Point(block.vertex_coordinates(5)[0],block.vertex_coordinates(5)[1],block.vertex_coordinates(5)[2])
    a6 =Point(block.vertex_coordinates(6)[0],block.vertex_coordinates(6)[1],block.vertex_coordinates(6)[2])
    a7 =Point(block.vertex_coordinates(7)[0],block.vertex_coordinates(7)[1],block.vertex_coordinates(7)[2])
    tm = Point((a2 + a3 + a6 + a7)[0]/4,(a2 + a3 + a6 + a7)[1]/4,(a2 + a3 + a6 + a7)[2]/4)
    x = -Vector((a3-a2)[0], (a3-a2)[1] , (a3-a2)[2])
    y = -Vector((a6-a2)[0], (a6-a2)[1] , (a6-a2)[2])
    frames.append(Frame(tm,x,y))



assembly.set_boundary_conditions([0,N-1])
frames = [Artist(f).draw() for f in frames]
# ---------- end python ----------
assembly_visualization = GhPythonScript(assembly=python.assembly)  # -> out, blocks, supports, all
# ---------- assembly_visualization: Python ----------
from compas.datastructures import Mesh
from compas_assembly.datastructures import Block
from compas_cra.datastructures import CRA_Assembly
from compas.artists import Artist
import Rhino.Geometry as rg




def block_to_mesh(block):
    mesh = Mesh()
    for i in block.vertices():
        coor = block.vertex_coordinates(i)
        mesh.add_vertex(key=i, x=coor[0], y=coor[1], z=coor[2])
    
    for i in block.faces():
        mesh.add_face(block.face_vertices(i))
        
    return mesh
    
def draw_blocks(assembly):
    supports = []
    blocks = []
    all = []
    for node in assembly.nodes():
        block = assembly.node_attribute(node, 'block')
        block_mesh = block_to_mesh(block)
        block_rgmesh = Artist(block_mesh)

#        vertexcolor = {vertex: (255, 0, 0) for vertex in block_mesh.vertices_where({'is_anchor': True})}
#        block_rgmesh.draw_vertices(color=vertexcolor)
#        block_rgmesh.draw_edges()
#        Artist.redraw()

        blocks.append(block_rgmesh.draw())
        all.append(block_rgmesh.draw())
    return supports, blocks, all

#Artist.clear()

if __name__ == "__main__":
    supports, blocks, all = draw_blocks(assembly)
# ---------- end assembly_visualization ----------
list_item = ListItem(List=assembly_visualization.blocks, Index=0, Wrap=True)
mesh = Mesh(assembly_visualization.blocks)
mesh_2 = Mesh(list_item)
deconstruct_mesh = DeconstructMesh(Mesh=mesh)  # -> Vertices, Faces, Colours, Normals
deconstruct_mesh_2 = DeconstructMesh(Mesh=mesh_2)  # -> Vertices, Faces, Colours, Normals
list_item_2 = ListItem(List=deconstruct_mesh.Vertices, Index=Slider(4, range=0..10), Wrap=True)  # -> Item, Item1, Item2, Item3
list_item_3 = ListItem(List=deconstruct_mesh_2.Vertices, Index=Slider(0, range=0..10), Wrap=True)  # -> Item, Item1, Item2, Item3
volume = Volume(Geometry=assembly_visualization.blocks)  # -> Volume, Centroid
_4point_surface = _4PointSurface(CornerA=list_item_2.Item, CornerB=list_item_2.Item1, CornerC=list_item_2.Item2, CornerD=list_item_2.Item3)
_4point_surface_2 = _4PointSurface(CornerA=list_item_3.Item, CornerB=list_item_3.Item1, CornerC=list_item_3.Item2, CornerD=list_item_3.Item3)
deconstruct = Deconstruct(Point=volume.Centroid)  # -> XComponent, YComponent, ZComponent
plane = Plane(_4point_surface)
point = Point(Point(0, 1, 0))
area = Area(Geometry=_4point_surface_2)  # -> Area, Centroid
area_2 = Area(Geometry=_4point_surface)  # -> Area, Centroid
plane_2 = Plane(_4point_surface_2)
rotate_3d = Rotate3D(Geometry=plane, Angle=1.570796327, Center=area_2.Centroid, Axis=point)  # -> Geometry, Transform
support = Point(area.Centroid)
deconstruct_2 = Deconstruct(Point=support)  # -> XComponent, YComponent, ZComponent
subtraction = Subtraction(A=deconstruct.XComponent, B=deconstruct_2.XComponent)
plane_closest_point = PlaneClosestPoint(Point=support, Plane=rotate_3d.Geometry)  # -> Point, UVPoint, Distance
panel = Panel(subtraction)
absolute = Absolute(Value=subtraction)  # -> flatten(Result)
absolute_2 = Absolute(Value=plane_closest_point.Distance)  # -> flatten(Result)
mass_addition = MassAddition(Input=absolute)  # -> Result, PartialResults
division = Division(A=mass_addition.PartialResults, B=absolute_2)
panel_2 = Panel(mass_addition.PartialResults)
panel_3 = Panel(division)

# ----
# 2 Frames
py_2 = GhPythonScript()  # -> F2
# ---------- py_2: Python ----------
from compas.geometry import Frame


F2 = Frame((0.8,0,0), [1,0,0], [0,1,0])
# ---------- end py_2 ----------
py_3 = GhPythonScript()  # -> F1
# ---------- py_3: Python ----------
from compas.geometry import Frame

F1 = Frame.worldXY()
# ---------- end py_3 ----------

mesh_3 = Mesh(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)
mesh_4 = Mesh(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)
deconstruct_mesh_3 = DeconstructMesh(Mesh=mesh_3)  # -> Vertices, Faces, Colours, Normals
deconstruct_mesh_4 = DeconstructMesh(Mesh=mesh_4)  # -> Vertices, Faces, Colours, Normals
list_item_4 = ListItem(List=deconstruct_mesh_3.Vertices, Index=Slider(4, range=0..10), Wrap=True)  # -> Item, Item1, Item2, Item3
list_item_5 = ListItem(List=deconstruct_mesh_4.Vertices, Index=Slider(0, range=0..10), Wrap=True)  # -> Item, Item1, Item2, Item3
_4point_surface_3 = _4PointSurface(CornerA=list_item_4.Item, CornerB=list_item_4.Item1, CornerC=list_item_4.Item2, CornerD=list_item_4.Item3)
_4point_surface_4 = _4PointSurface(CornerA=list_item_5.Item, CornerB=list_item_5.Item1, CornerC=list_item_5.Item2, CornerD=list_item_5.Item3)
area_3 = Area(Geometry=_4point_surface_3)  # -> Area, Centroid
mesh_5 = Mesh([<mesh referenced from the Rhino model> x10])
volume_2 = Volume(Geometry=mesh_5)  # -> Volume, Centroid
point_2 = Point(Point(0, 1, 0))
area_4 = Area(Geometry=_4point_surface_4)  # -> Area, Centroid
support_2 = Point(area_4.Centroid)
support_3 = Point(area_3.Centroid)
plane_3 = Plane(_4point_surface_4)
deconstruct_3 = Deconstruct(Point=volume_2.Centroid)  # -> XComponent, YComponent, ZComponent
rotate_3d_2 = Rotate3D(Geometry=plane_3, Angle=1.570796327, Center=support_2, Axis=point_2)  # -> Geometry, Transform
deconstruct_4 = Deconstruct(Point=support_3)  # -> XComponent, YComponent, ZComponent
plane_closest_point_2 = PlaneClosestPoint(Point=support_3, Plane=rotate_3d_2.Geometry)  # -> Point, UVPoint, Distance
subtraction_2 = Subtraction(A=deconstruct_3.XComponent, B=deconstruct_4.XComponent)
mass_addition_2 = MassAddition(Input=subtraction_2)  # -> Result, PartialResults
absolute_3 = Absolute(Value=plane_closest_point_2.Distance)
division_2 = Division(A=mass_addition_2.Result, B=absolute_3)

# ----
# Transformation between two frames
f2f = GhPythonScript(F1=py_3, F2=py_2)  # -> T
# ---------- f2f: Python ----------
from compas.geometry import Transformation

# change-basis transformation between two frames F1 and F2.
T = Transformation.from_frame_to_frame(F1, F2)
# ---------- end f2f ----------
py_4 = GhPythonScript(point=py, T=f2f)  # -> point_transformed
# ---------- py_4: Python ----------
point_transformed = point.transformed(T)
# ---------- end py_4 ----------
py_5 = GhPythonScript(F1=py_3, F2=py_2, point=py, point_transformed=py_4)  # -> P, A, V
# ---------- py_5: Python ----------
from compas.artists import Artist
import Rhino.Geometry as rg

# display
P = Artist(point_transformed).draw()
v = point_transformed - F2.point

A = [Artist(F1.point).draw(), Artist(F2.point).draw()]
V = [rg.Vector3d(*list(point)), rg.Vector3d(*list(v))]
# ---------- end py_5 ----------
vdis = VectorDisplay(Anchor=py_5.A, Vector=py_5.V)
pt_2 = Point(py_5.P)

path = FilePath("F:\Trimester3\fabrication\UR\0628_urtest.json")
from_json = FromJSON(json=path)  # -> result
#   port json: JSON file path or JSON string.
#   port result: Deserialized objects.
# ---------- from_json: Python ----------
"""
Deserializes JSON into COMPAS objects.
"""
from ghpythonlib.componentbase import executingcomponent as component

import compas


class CompasInfo(component):
    def RunScript(self, json):
        if not json:
            return None

        try:
            return compas.json_load(json)
        except:    # noqa: E722
            return compas.json_loads(json)
# ---------- end from_json ----------
dam = DataDam(DataA=Toggle(False), BufferDelay=10000000, BufferMode=0)
motion_planning = GhPythonScript(assembly=from_json, part_key=Slider(9, range=1..10), send=dam)  # -> out, assembly; disabled
# ---------- motion_planning: Python ----------
import simple_comm as c
import simple_ur_script as ur
import imp
imp.reload(ur)

import math as m
import os
import time

import compas
from compas.robots import Configuration
from compas.topology import breadth_first_ordering


assembly = assembly

script = ""
# script += ur.set_tcp_by_angles(float(-17.90), float(45.85), float(143.68), m.radians(0.0), m.radians(180.0), m.radians(90.0))
# script = c.concatenate_script(script)
# c.send_script(script,"192.168.10.10")

trajectory_keys = ("start_trajectory",
                   "pick_trajectory",
                   "pick_trajectory_after",
                   "freespace_trajectory",
                   "place_trajectory",
                   "place_trajectory_after",
                   "freespace_trajectory_after",)

# NOTE: Replace this with assembly.find_by_key after this is merged:
# https://github.com/compas-dev/compas/pull/1032

#script = ""
#script += ur.set_tcp_by_angles(float(-17.90), float(45.85), float(143.68), m.radians(0.0), m.radians(180.0), m.radians(90.0))




IO = 0
speed = 0.5  # rad/s
accel = 0.5  # rad/s^2
blendradius = 0.01 # <0.02m

part = assembly.graph.node_attribute(str(int(part_key)), "part")
if send:
    for traj_name in trajectory_keys:
        traj = part.attributes[traj_name]
        length = len(traj.points)
    
        # if traj_name == "pick_trajectory_after":
        #     #ur_io.setStandardDigitalOut(IO,True)
        #     #time.sleep(2) 
        # elif traj_name == "place_trajectory_after":
        #     # ur_io.setStandardDigitalOut(IO,False)
        #     # time.sleep(2) 
        
        for i in range(length):
            config = traj.points[i].joint_values
            script += ur.move_j(config, accel, speed,0, blendradius)

        
#        config = traj.points[-1].joint_values
#        #nowait = False
#        script += ur.move_j(config, accel, speed,0, blendradius)
script = c.concatenate_script(script)
c.send_script(script,"192.168.10.10")



print("Finished.")
# ---------- end motion_planning ----------

pt_3 = ConstructPoint(XCoordinate="606.26", YCoordinate="560.09", ZCoordinate="-39.47")

pt_4 = ConstructPoint(XCoordinate="-457.23", YCoordinate="91.78", ZCoordinate="491.92")

pt_5 = ConstructPoint(XCoordinate="766.08", YCoordinate="387.08", ZCoordinate="176.77")

pt_6 = ConstructPoint(XCoordinate="-456.21", YCoordinate="533.71", ZCoordinate="210.10")

pt_7 = ConstructPoint(XCoordinate="-539.81", YCoordinate="363.97", ZCoordinate="567.29")

pt_8 = ConstructPoint(XCoordinate="559.11", YCoordinate="60.68", ZCoordinate="883.95")

pt_9 = ConstructPoint(XCoordinate="-187.45", YCoordinate="26.72", ZCoordinate="49.60")

pt_10 = ConstructPoint(XCoordinate="-227.11", YCoordinate="562.93", ZCoordinate="-37.48")

pt_11 = ConstructPoint(XCoordinate="377.01", YCoordinate="527.44", ZCoordinate="207.59")

pt_12 = ConstructPoint(XCoordinate="383.90", YCoordinate="86.85", ZCoordinate="490.79")

pt_13 = ConstructPoint(XCoordinate="-69.94", YCoordinate="385.55", ZCoordinate="177.32")

pt_14 = ConstructPoint(XCoordinate="295.66", YCoordinate="357.42", ZCoordinate="564.14")

pt_15 = ConstructPoint(XCoordinate="383.36", YCoordinate="302.72", ZCoordinate="3.91")

pt_16 = ConstructPoint(XCoordinate="-281.28", YCoordinate="60.70", ZCoordinate="884.21")

pt_17 = ConstructPoint(XCoordinate="656.91", YCoordinate="24.81", ZCoordinate="49.79")

pt_18 = ConstructPoint(XCoordinate="-454.66", YCoordinate="310.14", ZCoordinate="5.66")

number_slider = Slider(1000, range=0..1000)
number_slider_2 = Slider(1000, range=0..1000)
division_3 = Division(A=pt_3, B=number_slider_2)
division_4 = Division(A=pt_8, B=number_slider_2)
division_5 = Division(A=pt_10, B=number_slider)
division_6 = Division(A=pt_15, B=number_slider_2)
division_7 = Division(A=pt_7, B=number_slider)
division_8 = Division(A=pt_13, B=number_slider)
division_9 = Division(A=pt_14, B=number_slider_2)
division_10 = Division(A=pt_16, B=number_slider)
division_11 = Division(A=pt_6, B=number_slider)
division_12 = Division(A=pt_18, B=number_slider)
division_13 = Division(A=pt_4, B=number_slider)
division_14 = Division(A=pt_11, B=number_slider_2)
division_15 = Division(A=pt_9, B=number_slider)
division_16 = Division(A=pt_5, B=number_slider_2)
division_17 = Division(A=pt_17, B=number_slider_2)
division_18 = Division(A=pt_12, B=number_slider_2)
pt_19 = Point(division_3)
pt_20 = Point(division_7)  # disabled
pt_21 = Point(division_13)
pt_22 = Point(division_4)
pt_23 = Point(division_15)  # disabled
pt_24 = Point(division_11)
pt_25 = Point(division_8)  # disabled
pt_26 = Point(division_5)
pt_27 = Point(division_6)
pt_28 = Point(division_10)
pt_29 = Point(division_12)
pt_30 = Point(division_16)  # disabled
pt_31 = Point(division_17)  # disabled
pt_32 = Point(division_18)
pt_33 = Point(division_9)  # disabled
pt_34 = Point(division_14)
dualrobotstransform4pt = GhPythonScript(
    ori_pt_A=pt_34,
    xAxis_pt_A=pt_22,
    yAxis_pt_A=pt_32,
    add_pt_A=pt_27,
    ori_pt_B=pt_24,
    xAxis_pt_B=pt_28,
    yAxis_pt_B=pt_21,
    add_pt_B=pt_29)  # -> out, P, pt_t, T; inputs ori_pt_A: Point3d, xAxis_pt_A: Point3d, yAxis_pt_A: Point3d, add_pt_A: Point3d, ori_pt_B: Point3d, xAxis_pt_B: Point3d, yAxis_pt_B: Point3d, add_pt_B: Point3d
# ---------- dualrobotstransform4pt: Python ----------
from compas.geometry import Frame
from compas.geometry import Point
from compas.geometry import Transformation
from compas.geometry import matrix_from_frame_to_frame as ma
import Rhino.Geometry as rg
import copy

A_pts = [ori_pt_A, xAxis_pt_A, yAxis_pt_A, add_pt_A]
B_pts = [ori_pt_B, xAxis_pt_B, yAxis_pt_B, add_pt_B]
Ts = []
ms = []
for i in range(len(A_pts)):
    list_A = copy.deepcopy(A_pts)
    list_B = copy.deepcopy(B_pts)
    list_A.pop(i)
    list_B.pop(i)
    FA = Frame.from_points(list_A[0],list_A[1],list_A[2])
    FB = Frame.from_points(list_B[0],list_B[1],list_B[2])
    T = Transformation.from_frame_to_frame(FB, FA)
    matrix = ma(FB, FA)
    #print matrix
    Ts.append(T)
    ms.append(matrix)


#T_ave = (Ts[0] + Ts[1] + Ts[2] + Ts[3])/4
#M_ave = ms[0] + ms[1] + ms[2] + ms[3]
print ms[0]
print Ts[0]
M_ave = copy.deepcopy(ms[0])
for i in range(4):
    for j in range(4):
        M_ave[i][j] = 0
        
        
for M in ms:
    for i in range(4):
        for j in range(4):
            M_ave[i][j] += 0.25 * M[i][j]

print M_ave
T = Transformation.from_matrix(M_ave)
Tinv = T.inverse()
# ---------- end dualrobotstransform4pt ----------
dualrobotstransform = GhPythonScript(ori_pt_A=pt_34, xAxis_pt_A=pt_22, yAxis_pt_A=pt_32, ori_pt_B=pt_24, xAxis_pt_B=pt_28, yAxis_pt_B=pt_21)  # -> out, P, pt_t, T; inputs ori_pt_A: Point3d, xAxis_pt_A: Point3d, yAxis_pt_A: Point3d, ori_pt_B: Point3d, xAxis_pt_B: Point3d, yAxis_pt_B: Point3d
# ---------- dualrobotstransform: Python ----------
from compas.geometry import Frame
from compas.geometry import Point
from compas.geometry import Transformation
import Rhino.Geometry as rg

F1 = Frame.from_points(ori_pt_A, xAxis_pt_A, yAxis_pt_A)
F2 = Frame.from_points(ori_pt_B, xAxis_pt_B, yAxis_pt_B)
print(F1.yaxis.length)
print(F2)

T = Transformation.from_frame_to_frame(F2, F1)

P = Point(0, 0, 0)  # local point in F1
pt = P.transformed(T)

pt_t = rg.Point3d(pt.x, pt.y, pt.z)
S,A,B,C,D = T.decomposed()
print (S,A,B,C,D)
print (S)
print (A)
print (B)
print (C)
print (D)
# ---------- end dualrobotstransform ----------
dualrobotstransform5pt = GhPythonScript(
    ori_pt_A=pt_34,
    xAxis_pt_A=pt_22,
    yAxis_pt_A=pt_32,
    add_pt_A=pt_27,
    add_pt_A2=pt_19,
    ori_pt_B=pt_24,
    xAxis_pt_B=pt_28,
    yAxis_pt_B=pt_21,
    add_pt_B=pt_29,
    add_pt_B2=pt_26)  # -> out, P, pt_t, T; inputs ori_pt_A: Point3d, xAxis_pt_A: Point3d, yAxis_pt_A: Point3d, add_pt_A: Point3d, add_pt_A2: Point3d, ori_pt_B: Point3d, xAxis_pt_B: Point3d, yAxis_pt_B: Point3d, add_pt_B: Point3d, add_pt_B2: Point3d
# ---------- dualrobotstransform5pt: Python ----------
from compas.geometry import Frame
from compas.geometry import Point
from compas.geometry import Transformation
from compas.geometry import matrix_from_frame_to_frame as ma
import Rhino.Geometry as rg
import copy
A_pts = [ori_pt_A, xAxis_pt_A, yAxis_pt_A, add_pt_A, add_pt_A2]
B_pts = [ori_pt_B, xAxis_pt_B, yAxis_pt_B, add_pt_B, add_pt_B2]
Ts = []
ms = []
for i in range(len(A_pts)):
    list_A = copy.deepcopy(A_pts)
    list_B = copy.deepcopy(B_pts)
    list_A.pop(i)
    list_B.pop(i)
    for j in range(len(list_A)):
        list_A2 = copy.deepcopy(list_A)
        list_B2 = copy.deepcopy(list_B)
        list_A2.pop(j)
        list_B2.pop(j)
        FA = Frame.from_points(list_A2[0],list_A2[1],list_A2[2])
        FB = Frame.from_points(list_B2[0],list_B2[1],list_B2[2])
        T = Transformation.from_frame_to_frame(FB, FA)
        matrix = ma(FB, FA)
        #print matrix
        Ts.append(T)
        ms.append(matrix)
#T_ave = (Ts[0] + Ts[1] + Ts[2] + Ts[3])/4
#M_ave = ms[0] + ms[1] + ms[2] + ms[3]
print ms[0]
print Ts[0]
M_ave = copy.deepcopy(ms[0])
for i in range(4):
    for j in range(4):
        M_ave[i][j] = 0
for M in ms:
    for i in range(4):
        for j in range(4):
            M_ave[i][j] += 0.05 * M[i][j]
print M_ave
T = Transformation.from_matrix(M_ave)

Tinv = T.inverse()
# ---------- end dualrobotstransform5pt ----------

# ----
# Robot Base
pl = ConstructPlane(Origin=Point(0, 0, 0), XAxis=Vector(1, 0, 0), YAxis=Vector(0, 1, 0))
plnaxis = PlaneAxis(P=PlaneXY(0, 0, 0), B=35)
robot_base = Robot_Base(reference_plane=pl)
ros_platfo = Scale(Geometry=robot_base, Center=Point(0, 0, 0), Factor=Slider(0.001, range=0..0.001))  # -> Geometry, Transform
Z = UnitZ(Factor=Slider(0.003, range=-0.1..0.1))
rotate = Rotate(Geometry=ros_platfo.Geometry, Angle=3.141592654, Plane=PlaneXY(0, 0, 0))  # -> Geometry, Transform
move = Move(Geometry=ros_platfo.Geometry, Motion=Z)  # -> Geometry, Transform

trigger = Trigger(Interval=2000, TimerInterval=2000, Target=python_2)  # disabled
python_2 = GhPythonScript()  # -> out, DO_A, DO_B; disabled
# ---------- python_2: Python ----------
import simple_ur_script as ur 
import simple_comm as c 
import imp

imp.reload(c)
part = 0

#print c.listen_to_robot("192.168.10.10")["di"]

DA = int(c.listen_to_robot("192.168.10.10")["d_out"][0])
print DA
if DA == 129:
    script_A = ""
    script_A += ur.set_digital_out(7, False)
    c.send_script(script_A, "192.168.10.10")
    script_B = ""
    #script_B += ...
    DO_B = 1
    DO_B = 0
    #c.send_script(script_B, "192.168.10.12")

DB = int(c.listen_to_robot("192.168.10.12")["di"][0])
if DB == 129:
    script_B = ""
    script_B += ur.set_digital_out(7, False)
    c.send_script(script_B, "192.168.10.12")
    script_A = ""
    #script_A += ...
    DO_A = 1
    DO_A = 0
    #c.send_script(script_A, "192.168.10.10")
"""
DI

0  -1  ||  4  -16
1  -2  ||  5  -32
2  -4  ||  6  -64
3  -8  ||  7  -128
"""
# ---------- end python_2 ----------

reality_platform = Geometry(ros_platfo.Geometry)

pl_3pt = Plane3Pt(PointA=pt_34, PointB=pt_22, PointC=pt_32)
pl_3pt_2 = Plane3Pt(PointA=pt_24, PointB=pt_28, PointC=pt_21)
pt_35 = ConstructPoint(XCoordinate=0, YCoordinate=0, ZCoordinate=0)
orient = Orient(Geometry=pt_35, Source=pl_3pt, Target=pl_3pt_2)  # -> Geometry, Transform
orient_2 = Orient(Geometry=reality_platform, Source=pl_3pt_2, Target=pl_3pt)  # -> Geometry, Transform

division_19 = Division(A=panel_3, B=Slider(4, range=0..10))
python_3 = GhPythonScript(DO_A=python_2.DO_A, DO_B=python_2.DO_B)  # -> out, a; disabled
# ---------- python_3: Python ----------
if DO_B == 1:
    pass
    #c.send_script(script_B, "192.168.10.12")
if DO_A == 1:
    pass
    #c.send_script(script_A, "192.168.10.10")
# ---------- end python_3 ----------
multiplication = Multiplication(A=division_19, B=Slider(13.6, range=0..100))
rad = Radians(Degrees=multiplication)
panel_4 = Panel(rad)
# 0. Generate Rhino Mesh for Support and Blocks
python_4 = GhPythonScript(T=dualrobotstransform5pt.T)  # -> out, assembly, frames, side_frames
# ---------- python_4: Python ----------
from compas_assembly.geometry import Arch
from compas_cra.datastructures import CRA_Assembly
from compas_assembly.datastructures import Block
from compas.datastructures import Mesh
from compas.geometry import Point, Frame, Vector
from compas.artists import Artist
from compas.geometry import Transformation

assembly = CRA_Assembly()
N = 12
arch = Arch(rise = 150/1000, span = 300/1000, thickness = 20/1000, depth = 20/1000, n = N)
frames = []
side_frames = []
Tinv = T.inverse()
for i, block in enumerate(arch.blocks()):
    assembly.add_block(Block.from_shape(block), key=i)
    a0 =Point(block.vertex_coordinates(0)[0],block.vertex_coordinates(0)[1],block.vertex_coordinates(0)[2])
    a1 =Point(block.vertex_coordinates(1)[0],block.vertex_coordinates(1)[1],block.vertex_coordinates(1)[2])
    a2 =Point(block.vertex_coordinates(2)[0],block.vertex_coordinates(2)[1],block.vertex_coordinates(2)[2])
    a3 =Point(block.vertex_coordinates(3)[0],block.vertex_coordinates(3)[1],block.vertex_coordinates(3)[2])
    a4 =Point(block.vertex_coordinates(4)[0],block.vertex_coordinates(4)[1],block.vertex_coordinates(4)[2])
    a5 =Point(block.vertex_coordinates(5)[0],block.vertex_coordinates(5)[1],block.vertex_coordinates(5)[2])
    a6 =Point(block.vertex_coordinates(6)[0],block.vertex_coordinates(6)[1],block.vertex_coordinates(6)[2])
    a7 =Point(block.vertex_coordinates(7)[0],block.vertex_coordinates(7)[1],block.vertex_coordinates(7)[2])
    tm = Point((a2 + a3 + a6 + a7)[0]/4,(a2 + a3 + a6 + a7)[1]/4,(a2 + a3 + a6 + a7)[2]/4)
    side_tm = Point((a1 + a2 + a5 + a6)[0]/4,(a1 + a2 + a5 + a6)[1]/4,(a1 + a2 + a5 + a6)[2]/4)
    x = -Vector((a3-a2)[0], (a3-a2)[1] , (a3-a2)[2])
    y = -Vector((a6-a2)[0], (a6-a2)[1] , (a6-a2)[2])
    side_x = Vector((a2-a1)[0], (a2-a1)[1] , (a2-a1)[2])
    side_y = Vector((a5-a1)[0], (a5-a1)[1] , (a5-a1)[2])
#    Tinv = T.inverse()
    #frame = Frame(tm,x,y).transformed(Tinv)
    frames.append(Frame(tm,x,y))
    #frames.append(frame)
    #side_frame = Frame(side_tm,side_x,side_y).transformed(Tinv)
    side_frames.append(Frame(side_tm,side_x,side_y))
    #side_frames.append(side_frame)



assembly.set_boundary_conditions([0,N-1])
frames = [Artist(f).draw() for f in frames]
side_frames = [Artist(f).draw() for f in side_frames]
# ---------- end python_4 ----------

pt_36 = ConstructPoint(XCoordinate=Slider(0.4, range=-1..1), YCoordinate=Slider(0.3, range=-1..1), ZCoordinate=Slider(0.003, range=-1..1))

# ----
# CRA_Analysis & Fabrication
python_5 = GhPythonScript()  # -> out, assembly, frames
# ---------- python_5: Python ----------
from compas_assembly.geometry import Arch
from compas_cra.datastructures import CRA_Assembly
from compas_assembly.datastructures import Block
from compas.datastructures import Mesh
from compas.geometry import Point, Frame, Vector
from compas.artists import Artist

assembly = CRA_Assembly()
N = 12
arch = Arch(rise = 150/1000, span = 300/1000, thickness = 20/1000, depth = 20/1000, n = N)
frames = []
for i, block in enumerate(arch.blocks()):
    assembly.add_block(Block.from_shape(block), key=i)
    a0 =Point(block.vertex_coordinates(0)[0],block.vertex_coordinates(0)[1],block.vertex_coordinates(0)[2])
    a1 =Point(block.vertex_coordinates(1)[0],block.vertex_coordinates(1)[1],block.vertex_coordinates(1)[2])
    a2 =Point(block.vertex_coordinates(2)[0],block.vertex_coordinates(2)[1],block.vertex_coordinates(2)[2])
    a3 =Point(block.vertex_coordinates(3)[0],block.vertex_coordinates(3)[1],block.vertex_coordinates(3)[2])
    a4 =Point(block.vertex_coordinates(4)[0],block.vertex_coordinates(4)[1],block.vertex_coordinates(4)[2])
    a5 =Point(block.vertex_coordinates(5)[0],block.vertex_coordinates(5)[1],block.vertex_coordinates(5)[2])
    a6 =Point(block.vertex_coordinates(6)[0],block.vertex_coordinates(6)[1],block.vertex_coordinates(6)[2])
    a7 =Point(block.vertex_coordinates(7)[0],block.vertex_coordinates(7)[1],block.vertex_coordinates(7)[2])
    tm = Point((a2 + a3 + a6 + a7)[0]/4,(a2 + a3 + a6 + a7)[1]/4,(a2 + a3 + a6 + a7)[2]/4)
    x = Vector((a3-a2)[0], (a3-a2)[1] , (a3-a2)[2])
    y = Vector((a6-a2)[0], (a6-a2)[1] , (a6-a2)[2])
    frames.append(Frame(tm,x,y))



assembly.set_boundary_conditions([0,N-1])
frames = [Artist(f).draw() for f in frames]
# ---------- end python_5 ----------
pt_37 = ConstructPoint(XCoordinate="-0.0012", YCoordinate="0.445", ZCoordinate="0.002")
# 0. Generate Rhino Mesh for Support and Blocks
assembly_visualization_2 = GhPythonScript(assembly=python_5.assembly)  # -> out, blocks, supports, all
# ---------- assembly_visualization_2: Python ----------
from compas.datastructures import Mesh
from compas_assembly.datastructures import Block
from compas_cra.datastructures import CRA_Assembly
from compas.artists import Artist
import Rhino.Geometry as rg




def block_to_mesh(block):
    mesh = Mesh()
    for i in block.vertices():
        coor = block.vertex_coordinates(i)
        mesh.add_vertex(key=i, x=coor[0], y=coor[1], z=coor[2])
    
    for i in block.faces():
        mesh.add_face(block.face_vertices(i))
        
    return mesh
    
def draw_blocks(assembly):
    supports = []
    blocks = []
    all = []
    for node in assembly.nodes():
        block = assembly.node_attribute(node, 'block')
        block_mesh = block_to_mesh(block)
        block_rgmesh = Artist(block_mesh)

#        vertexcolor = {vertex: (255, 0, 0) for vertex in block_mesh.vertices_where({'is_anchor': True})}
#        block_rgmesh.draw_vertices(color=vertexcolor)
#        block_rgmesh.draw_edges()
#        Artist.redraw()

        if assembly.node_attribute(node, 'is_support'):
            supports.append(block_rgmesh.draw())
        else:
            blocks.append(block_rgmesh.draw())
        all.append(block_rgmesh.draw())
    return supports, blocks, all

#Artist.clear()

if __name__ == "__main__":
    supports, blocks, all = draw_blocks(assembly)
# ---------- end assembly_visualization_2 ----------
assembly_visualization_3 = GhPythonScript(assembly=python_4.assembly)  # -> out, blocks, supports, all; same code as assembly_visualization_2
mesh_6 = Mesh(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)
mesh_7 = Mesh([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])
mesh_8 = Mesh(assembly_visualization_3.all)
pln = Plane(python_4.frames)
pl_2 = ConstructPlane(Origin=pt_37, XAxis=Vector(1, 0, 0), YAxis=Vector(0, 1, 0))
mesh_9 = Mesh(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)
mesh_10 = Mesh([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])
pln_2 = Plane(python_4.side_frames)
rotate_2 = Rotate(Geometry=pln, Angle=4.71238898, Plane=PlaneXY(0, 0, 0))  # -> Geometry, Transform
rotate_3 = Rotate(Geometry=mesh_8, Angle=4.71238898, Plane=PlaneXY(0, 0, 0))  # -> Geometry, Transform
rotate_4 = Rotate(Geometry=pln_2, Angle=4.71238898, Plane=PlaneXY(0, 0, 0))  # -> Geometry, Transform

# ---- group: Pick_station
geo = Geometry(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)

# ----
mesh_11 = Mesh(assembly_visualization_2.all)
pln_3 = Plane(python_5.frames)
move_2 = Move(Geometry=rotate_4.Geometry, Motion=pt_36)  # -> Geometry, Transform
python_6 = GhPythonScript(T=dualrobotstransform5pt.T)  # -> out, T_r, Tinv_r
# ---------- python_6: Python ----------
import compas_rhino.conversions as conversions 
from compas.geometry import Frame
from compas.geometry import Transformation

Tinv = T.inverse()
T_r = conversions.xform_to_rhino(T)
Tinv_r = conversions.xform_to_rhino(Tinv)

frame_0 = Frame([0,0,0],[1,0,0,],[0,1,0])
frame_t = frame_0.transformed(Tinv)

rpy = frame_t.euler_angles(static=True, axes='xyz')
print rpy
# ---------- end python_6 ----------
move_3 = Move(Geometry=rotate_2.Geometry, Motion=pt_36)  # -> Geometry, Transform
python_7 = GhPythonScript(T=dualrobotstransform5pt.T)  # -> out, a
# ---------- python_7: Python ----------
import Rhino.Geometry as rg
from compas.geometry import Frame
import compas
compas.PRECISION = '12f'


Tinv = T.inverse()
#frame_A = Frame([299.592,101.30,10.14],[1,0,0],[0,1,0])
frame_A = Frame([0.29956,0.10144,-0.00976],[1,0,0],[0,1,0])
frame_A = Frame([0.29956,0.10144,0.01014],[1,0,0],[0,1,0])
#frame_B = Frame([491.86,91.73,8.52],[1,0,0],[0,1,0])
frame_B = Frame([0.49186,0.09173,0.00852],[1,0,0],[0,1,0])
new_frame_B = frame_A.transformed(Tinv)
new_frame_A = frame_B.transformed(Tinv)
#print ('point : %.12f %.12f %.12f') % (new_frame_B.point[0], new_frame_B.point[1], new_frame_B.point[2])
#print ('vec : %.12f %.12f %.12f') % (new_frame_B.xaxis[0],new_frame_B.xaxis[1],new_frame_B.xaxis[2])
#print new_frame_B
#Frame(Point(0.492, -0.093, 0.087), Vector(-1.000, -0.012, 0.002), Vector(-0.012, 1.000, 0.000))
#return Frame((-0.3, -0.1, 0.010), (-1, 0, 0), (0, 1, 0))

frame_C = Frame([0.3, 0.1, 0.364],[1,0,0],[0,1,0])
new = frame_C.transformed(Tinv)
print new
# ---------- end python_7 ----------
move_4 = Move(Geometry=rotate_3.Geometry, Motion=pt_36)  # -> Geometry, Transform
xy = XYPlane(Origin=Point(0, 0, 0))
rotate_5 = Rotate(Geometry=geo, Angle=degrees(Slider(180, range=0..1000)), Plane=PlaneXY(0, 0, 0))  # -> Geometry, Transform
pt_38 = ConstructPoint(XCoordinate=Slider(0.3, range=0..1), YCoordinate=Slider(0.1, range=0..0.1), ZCoordinate=Slider(0.364, range=0..1))
rotate_6 = Rotate(Geometry=pln_3, Angle=4.71238898, Plane=PlaneXY(0, 0, 0))  # -> Geometry, Transform
rotate_7 = Rotate(Geometry=mesh_11, Angle=4.71238898, Plane=PlaneXY(0, 0, 0))  # -> Geometry, Transform
python_8 = GhPythonScript(blocks=move_4.Geometry, frames=move_3.Geometry, hold_frames=move_2.Geometry, T_r=python_6.T_r, Tinv_r=python_6.Tinv_r)  # -> out, blocks, frames, hold_frames; inputs blocks: list of Mesh, frames: list, hold_frames: list
# ---------- python_8: Python ----------
import Rhino.Geometry as rg

for block in blocks:
    block = block.Transform(Tinv_r)


for frame in frames:
    frame = frame.Transform(Tinv_r)
    

for hold_frame in hold_frames:
    hold_frame = hold_frame.Transform(Tinv_r)
# ---------- end python_8 ----------
python_9 = GhPythonScript(blocks=move_4.Geometry, frames=xy, T_r=python_6.T_r, Tinv_r=python_6.Tinv_r)  # -> out, blocks, frames, hold_frames; inputs blocks: list of Mesh, frames: list, hold_frames: list
# ---------- python_9: Python ----------
import Rhino.Geometry as rg

for frame in frames:
    frame = frame.Transform(Tinv_r)

print frames[0].Origin
print frames[0].XAxis
print frames[0].YAxis
print frames[0].ZAxis
print frames[0].Normal
# ---------- end python_9 ----------
pl_3 = ConstructPlane(Origin=pt_38, XAxis=Vector(1, 0, 0), YAxis=Vector(0, 1, 0))
# 1. Generate Compas_Geometry
cra_geometry = GhPythonScript(blocks=assembly_visualization_2.blocks, supports=assembly_visualization_2.supports)  # -> out, cra_geo; inputs blocks: list of Mesh, supports: list of Mesh
# ---------- cra_geometry: Python ----------
import Rhino.Geometry as rg
from compas.datastructures import Mesh
from compas_rhino.conversions import RhinoMesh


class cra_geometry():
    def __init__(self, rg_blocks, rg_supports):
        compas_blocks = [RhinoMesh.from_geometry(rg_block).to_compas() for rg_block in rg_blocks]
        compas_supports = [RhinoMesh.from_geometry(rg_support).to_compas()  for rg_support in rg_supports]
        self.blocks = compas_blocks
        self.supports = compas_supports
    
    def blocks(self):
        return self.blocks

    def supports(self):
        return self.supports

if __name__ =="__main__":
    cra_geo = cra_geometry(blocks, supports)
# ---------- end cra_geometry ----------
number_slider_3 = Slider(9, range=1..10)
move_5 = Move(Geometry=rotate_6.Geometry, Motion=pt_36)  # -> Geometry, Transform
# 0. Generate Assembly (part)
move_6 = Move(Geometry=rotate_7.Geometry, Motion=pt_36)  # -> Geometry, Transform
# 0. Generate Assembly (part)
python_10 = GhPythonScript(blocks=python_8.blocks, frames=python_8.frames, hold_frames=python_8.hold_frames)  # -> out, wall, bricks, shapes; inputs blocks: list, frames: list, hold_frames: list
# ---------- python_10: Python ----------
from compas.datastructures import Assembly
from compas.geometry import Frame
from compas.datastructures import Mesh
from compas.datastructures import Part
from compas_rhino.conversions import RhinoMesh, plane_to_compas_frame
from compas.geometry import Polyhedron
from compas.geometry import Transformation
from compas.artists import Artist
import Rhino.Geometry as rg

wall = Assembly("test")
shapes = []

for i, block in enumerate(blocks):
    
    ######################################################
    # Transform Blocks to Origin
    ######################################################
    
    a = RhinoMesh.from_geometry(block).to_compas()
    shape = Polyhedron(*a.to_vertices_and_faces()) #standard format
    frame = plane_to_compas_frame(frames[i])
    hold_frame = plane_to_compas_frame(hold_frames[i])
    T = Transformation.from_frame_to_frame(hold_frame,Frame([0,0,0], [1,0,0],[0,1,0]))
    #T = Transformation.from_change_of_basis(Frame([0,0,0], [1,0,0],[0,-1,0]), frame)
    print(T)
    shape2 = shape.transformed(T)
    shapes.append(shape2)
    
    ######################################################
    # Create Parts for Fabrication
    ######################################################
    part = Part (frame = hold_frame , shape = shape2)
    wall.add_part(part, key = str(i))
    
bricks = [Artist(brick.geometry).draw() for brick in wall.parts()]
shapes = [Artist(shape).draw() for shape in shapes]
# ---------- end python_10 ----------
python_11 = GhPythonScript(blocks=move_6.Geometry, frames=move_5.Geometry)  # -> out, wall, bricks, shapes; inputs blocks: list, frames: list
# ---------- python_11: Python ----------
from compas.datastructures import Assembly
from compas.geometry import Frame
from compas.datastructures import Mesh
from compas.datastructures import Part
from compas_rhino.conversions import RhinoMesh, plane_to_compas_frame
from compas.geometry import Polyhedron
from compas.geometry import Transformation
from compas.artists import Artist
import math 
import Rhino.Geometry as rg

wall = Assembly("test")
shapes = []

for i, block in enumerate(blocks):
    
    ######################################################
    # Transform Blocks to Origin
    ######################################################
    
    a = RhinoMesh.from_geometry(block).to_compas()
    shape = Polyhedron(*a.to_vertices_and_faces()) #standard format
    frame = plane_to_compas_frame(frames[i])
    T = Transformation.from_frame_to_frame(frame,Frame([0,0,0], [1,0,0],[0,1,0]))
    #T = Transformation.from_change_of_basis(Frame([0,0,0], [1,0,0],[0,-1,0]), frame)
    print(T)
    shape2 = shape.transformed(T)
    shapes.append(shape2)
    
    ######################################################
    # Create Parts for Fabrication
    ######################################################
    part = Part (frame = frame , shape = shape2)
    wall.add_part(part, key = str(i))
    
bricks = [Artist(brick.geometry).draw() for brick in wall.parts()]
shapes = [Artist(shape).draw() for shape in shapes]
# ---------- end python_11 ----------
geo_2 = Geometry(python_9.frames)
panel_5 = Panel(geo_2)
number_slider_4 = Slider(1, range=0..1)
mesh_12 = Mesh(python_11.shapes)
mesh_13 = Mesh(python_11.bricks)
rotate_8 = Rotate(Geometry=mesh_13, Angle=degrees(Slider(180, range=0..1000)), Plane=PlaneXY(0, 0, 0))  # -> Geometry, Transform
mesh_14 = Mesh(python_10.bricks)
mesh_15 = Mesh(python_10.shapes)
# 2. Run CRA_ANALYSIS
python_12 = GhPythonScript(cra_geo=cra_geometry.cra_geo, on=Toggle(False))  # -> out, assembly
# ---------- python_12: Python ----------
import math as mt

from compas.datastructures import Mesh
from compas.geometry import Box
from compas.geometry import Frame
from compas.geometry import Translation
from compas_assembly.datastructures import Block
from compas_cra.datastructures import CRA_Assembly
from compas_cloud import Proxy
#from compas_cra.datastructures import assembly_interfaces_numpy
#from compas_cra.equilibrium import cra_solve, cra_penalty_solve
#from compas_cra.viewers import cra_view

################################################################
#Create Assembly
################################################################
assembly = CRA_Assembly()

for i, block in enumerate(cra_geo.blocks):
    assembly.add_block(Block.from_shape(block), key=i)

support_list = []
for j, support in enumerate(cra_geo.supports):
    assembly.add_block(Block.from_shape(support), key=i + j + 1)
    support_list.append(i+j+1)

assembly.set_boundary_conditions(support_list)

################################################################
#Create Analysis Interfaces
################################################################


proxy = Proxy()
assembly_interfaces_numpy = proxy.function('compas_cra.datastructures.assembly_interfaces_numpy', cache = True)
assembly = assembly_interfaces_numpy(assembly, nmax=10, amin=1e-8, tmax=1e-5)
print(assembly)

################################################################
#Solve and Visualization
################################################################

mu = 0.9
dispbnd = 1e-1
overlap = 1e-3
d = 0.15
if on:
    cra_solve = proxy.function('compas_cra.equilibrium.cra_solve')
    #cra_solve(assembly, verbose=True, timer=True)
    cra_solve(assembly, verbose=True, density=d, d_bnd=dispbnd, eps=overlap, mu=mu)
    #cra_penalty_solve = proxy.function('compas_cra.equilibrium.cra_penalty_solve',cache=True)
    #cra_penalty_solve(assembly, verbose=True, density=d, d_bnd=dispbnd, eps=overlap, mu=mu)

    cra_view = proxy.function('compas_cra.viewers.cra_view')
    cra_view(assembly, resultant=False, nodal=True, grid=True, weights=False,displacements=True, dispscale=1, scale=100000*d)
    #cra_view(assembly, resultant=False, nodal=True, grid=True,
    #         displacements=True, dispscale=10)
# ---------- end python_12 ----------
path_2 = FilePath("C:\Users\jingwen\Downloads\drive-download-20220627T104616Z-001\cra_assembly_result.json")
# 1. Generate Sequence
linear_sequence = GhPythonScript(wall=python_11.wall)  # -> out, assembly
# ---------- linear_sequence: Python ----------
import compas
from compas.utilities import pairwise

assembly = wall

# Define connectivity as a linear sequence of integers
linear_sequence = sorted(assembly.parts(), key=lambda p: int(p.key))
for a, b in pairwise(linear_sequence):
    assembly.add_connection(a, b)

print([part.key for part in linear_sequence])
# ---------- end linear_sequence ----------
subtraction_3 = Subtraction(A=number_slider_3, B=Slider(0, range=0..100))
number_slider_5 = Slider(3, range=0..10)
# 1. Generate Sequence
linear_sequence_2 = GhPythonScript(wall=python_10.wall)  # -> out, assembly; same code as linear_sequence
toggle = BooleanToggle(False)
to_json = ToJSON(data=python_12.assembly, filepath=path_2, pretty=Toggle(False))  # -> json; inputs pretty: Boolean
#   port data: COMPAS data objects to serialize.
#   port filepath: File path where to store the JSON file. If empty, it will not store to disk but instead return the JSON string.
#   port pretty: If True, JSON data will be formatted with indentation and key sorting.
#   port json: JSON file path or JSON string.
# ---------- to_json: Python ----------
"""
Serializes COMPAS objects to JSON.
"""
from ghpythonlib.componentbase import executingcomponent as component

import compas


class CompasInfo(component):
    def RunScript(self, data, filepath, pretty):
        json = filepath

        if filepath:
            compas.json_dump(data, filepath, pretty)
        else:
            json = compas.json_dumps(data, pretty)

        return json
# ---------- end to_json ----------
# 3. Result Visualization (need to be imporved)
assembly_visualization_4 = GhPythonScript(assembly=python_12.assembly)  # -> out, blocks, supports
# ---------- assembly_visualization_4: Python ----------
from compas.datastructures import Mesh
from compas_assembly.datastructures import Block
from compas_cra.datastructures import CRA_Assembly
from compas.artists import Artist
import Rhino.Geometry as rg




def block_to_mesh(block):
    mesh = Mesh()
    for i in block.vertices():
        coor = block.vertex_coordinates(i)
        mesh.add_vertex(key=i, x=coor[0], y=coor[1], z=coor[2])
    
    for i in block.faces():
        mesh.add_face(block.face_vertices(i))
        
    return mesh
    
def draw_blocks(assembly):
    supports = []
    blocks = []
    for node in assembly.nodes():
        block = assembly.node_attribute(node, 'block')
        block_mesh = block_to_mesh(block)
        block_rgmesh = Artist(block_mesh)

#        vertexcolor = {vertex: (255, 0, 0) for vertex in block_mesh.vertices_where({'is_anchor': True})}
#        block_rgmesh.draw_vertices(color=vertexcolor)
#        block_rgmesh.draw_edges()
#        Artist.redraw()

        if assembly.node_attribute(node, 'is_support'):
            supports.append(block_rgmesh.draw())
        else:
            blocks.append(block_rgmesh.draw())
    return supports, blocks

#Artist.clear()

if __name__ == "__main__":
    supports, blocks = draw_blocks(assembly)
# ---------- end assembly_visualization_4 ----------

panel_6 = Panel("""255.66
-83.86
125.99
227.91
-90.07
165.86""")
rad_2 = Radians(Degrees=panel_6)
panel_7 = Panel(rad_2)
multiplication_2 = Multiplication(A=panel_7, B=1000)
int = Integer(multiplication_2)
division_20 = Division(A=int, B=1000)
panel_8 = Panel(division_20)

motion_planning_2 = GhPythonScript(assembly=linear_sequence.assembly, part_keyvalue=number_slider_3, all=Toggle(False), last=toggle)  # -> out, assembly
# ---------- motion_planning_2: Python ----------
import math
import os
from compas_fab.backends import RosClient
from compas_fab.robots import AttachedCollisionMesh
from compas_fab.robots import CollisionMesh
from compas_fab.robots import PlanningScene
from compas_fab.robots import Tool
from compas.geometry import Transformation

import compas
from compas.datastructures import Mesh
from compas.geometry import Box
from compas.geometry import Frame
from compas.geometry import Vector
from compas.geometry import Translation
from compas.geometry import Scale
from compas.topology import breadth_first_ordering
import Grasshopper as gh
from compas.artists import Artist


assembly = assembly

def from_real_to_ROS(geo):
    T_from_real_to_ROS = Transformation.from_euler_angles([0,0,math.pi])
    ROS_geo = geo.transformed(T_from_real_to_ROS)
    return ROS_geo

def from_ROS_to_real(geo):
    T_from_ROS_to_real = Transformation.from_euler_angles([0,0,-math.pi])
    real_geo = geo.transformed(T_from_ROS_to_real)
    return real_geo


def get_tool():
    current_folder =os.path.dirname(ghdoc.Path)
    mesh = Mesh.from_stl(os.path.join(current_folder, "vacuum_suction_simplified.stl"))
    #mesh = Mesh.from_stl("vacuum_suction_simplified.stl")#0.078
    #mesh = Mesh.from_stl("vacuum_gripper_simplified.stl")#0.064
    frame = Frame([0, 0, 0.078], [1, 0, 0], [0, 1, 0])
    #frame = Frame([-0.00035, -0.00070, 0.078], [1, 0, 0], [0, 1, 0])
    tool = Tool(mesh, frame, link_name="wrist_3_link")
    return tool

def get_pre_approach_vector(part_key):
    part = assembly.graph.node_attribute(part_key, "part")
    ROS_frame = from_real_to_ROS(part.frame)
    pre_approach_vector = ROS_frame.yaxis.scaled(0.03)
    return pre_approach_vector
    
def get_approach_vector(part_key):
    part = assembly.graph.node_attribute(part_key, "part")
    ROS_frame = from_real_to_ROS(part.frame)
    approach_vector = ROS_frame.zaxis.scaled(-0.1) + get_pre_approach_vector(part_key)
    return approach_vector
    
def get_last_approach_vector(part_key):
    part = assembly.graph.node_attribute(part_key, "part")
    ROS_frame = from_real_to_ROS(part.frame)
    last_approach_vector = ROS_frame.zaxis.scaled(-0.1)
    return last_approach_vector


def get_pick_frame(part_key):
    #return Frame((0.3, 0.1, 0.364), (-1, 0, 0), (0, 1, 0))
    frame = Frame((-0.0012, 0.445, 0.001), (-1, 0, 0), (0, 1, 0))
    #frame = Frame((-0.0012, 0.445, 0.009), (-1, 0, 0), (0, 1, 0))
    ROS_frame = from_real_to_ROS(frame)
    print ROS_frame
    return ROS_frame


def get_place_frame(part_key):
    part = assembly.graph.node_attribute(part_key, "part")
    place_frame_ROS = from_real_to_ROS(part.frame)
    return place_frame_ROS


def prepare_scene(robot, part_key):
    scene = PlanningScene(robot)
    box = Box.from_diagonal([(-0.7, -0.7, -0.03), (0.7, 0.7, -0.05)])
    mesh = Mesh.from_shape(box)
    #mesh_ROS = from_real_to_ROS(mesh)
    scene.add_collision_mesh(CollisionMesh(mesh, "floor"))

    for k in get_part_sequence():
        if part_key == k:
            break

        part = assembly.graph.node_attribute(k, "part")
        mesh = Mesh.from_shape(part.shape)
        
        S = Scale.from_factors([0.99]*3,Frame([0,0,0],[1,0,0],[0,1,0]))
        mesh_scaled = mesh.transformed(S)
        part_ROS_frame = from_real_to_ROS(part.frame)
        
        scene.append_collision_mesh(CollisionMesh(mesh_scaled, "brick_wall", frame=part_ROS_frame))
        t = Transformation.from_frame_to_frame(Frame([0,0,0],[1,0,0],[0,1,0]),part_ROS_frame)



def get_start_configuration(robot):
    config = robot.zero_configuration()
    #config.joint_values = (-0.306, 4.351, 2.231, -2.869, 4.712, 1.465)
    #config.joint_values = (0.489, -1.77, 2.15, -2.869,-0.875, -0.575)
    #config.joint_values = (-1.878,-1.682,2.139,-2.01,-1.556,-0.313)
    #config.joint_values = (3.1415 - 2.797239,-1.644449,1.869073,4.488987,-1.672898,2.358463)
    #config.joint_values = (2.917,-1.906,1.964,4.678,-1.563,1.653)
    config.joint_values = (4.462,-1.464,2.199,3.978,-1.572,2.895)
    #config.joint_values = (-0.238,-1.445,2.20,-2.02,-1.47,3.60)
    return config


def get_part_shape(part_key):
    part = assembly.graph.node_attribute(part_key, "part")
    return part.shape


def get_part_sequence():
    root_part_key = "0"
    sequence = breadth_first_ordering(assembly.graph.adjacency, root_part_key)
    return sequence


def get_tolerance_joints():
    return [math.radians(1)] * 6


def get_planner_id():
    #return "TRRT"
    return "RRT"
    #return "RRT*"


# PICK & PLACE PROCEDURE

def adjust_to_attached_tool(robot, frame):
    if not robot.attached_tool:
        return frame
    return robot.from_tcf_to_t0cf([frame])[0]

real_frames = [
"approach_pick_frame_real",
"pick_frame_real",
"approach_place_frame_real",
"pre_approach_place_frame_real",
"place_frame_real",
"last_approach_place_frame_real"
]

client = RosClient("localhost")
client.run()

robot = client.load_robot()

start_configuration = get_start_configuration(robot)

tool = get_tool()
if tool:
    robot.attach_tool(tool)

assembly.attributes['start_configuration'] = start_configuration.data
assembly.attributes['tool'] = tool.data
check_mesh = []
#for part_key in get_part_sequence():

if all:
    a = 1
    b = 11
else:
    a = int(part_keyvalue)
    b = a + 1
    
for part_key in get_part_sequence()[a:b]:   # NOTE: For quick testing, only take the first few parts in the sequence
    part = assembly.graph.node_attribute(part_key, "part")
    
    scene = PlanningScene(robot)
    scene.reset()
    prepare_scene(robot, part_key)

    print("Part {}\n--------".format(part_key))
    print(" [  ] Pick frame + approach vector reachability\r")
    pick_frame = adjust_to_attached_tool(robot, get_pick_frame(part_key))
    approach_pick_frame = pick_frame.transformed(
        Translation.from_vector([0,0,0.05])
    )
    pick_frame_real = from_ROS_to_real(pick_frame)
    part.attributes["pick_frame_real"] = pick_frame_real
    approach_pick_frame_real = pick_frame_real.transformed(
        Translation.from_vector([0,0,0.05])
    )
    part.attributes["approach_pick_frame_real"] = pick_frame_real
    
    approach_pick_config = robot.inverse_kinematics(
        approach_pick_frame, start_configuration
    )
    part.attributes["approach_pick_config"] = approach_pick_config
    print(" [OK]")

    print(" [  ] Pick frame\r")
    pick_config = robot.inverse_kinematics(pick_frame, approach_pick_config)
    part.attributes["pick_config"] = pick_config
    print(" [OK]")

    print(" [  ] Place frame + approach vector\r")
    place_frame = adjust_to_attached_tool(robot, get_place_frame(part_key))
    last_approach_place_frame = place_frame.transformed(
            Translation.from_vector(get_last_approach_vector(part_key))
            )
    if not last:
        approach_place_frame = place_frame.transformed(
            Translation.from_vector(get_approach_vector(part_key))
        )
    else:
        approach_place_frame = place_frame.transformed(
            Translation.from_vector(get_last_approach_vector(part_key))
            )
    pre_approach_place_frame = place_frame.transformed(
        Translation.from_vector(get_pre_approach_vector(part_key))
    )
    
    
    place_frame_real = from_ROS_to_real(place_frame)
    part.attributes["place_frame_real"] = place_frame_real
    pre_approach_place_frame_real = from_ROS_to_real(pre_approach_place_frame)
    part.attributes["pre_approach_place_frame_real"] = pre_approach_place_frame_real
    approach_place_frame_real = from_ROS_to_real(approach_place_frame)
    part.attributes["approach_place_frame_real"] = approach_place_frame_real
    last_approach_place_frame_real = from_ROS_to_real(last_approach_place_frame)
    part.attributes["last_approach_place_frame_real"] = last_approach_place_frame_real
    
    # we use the approach pick config as start, because we estimate is the closest
    approach_place_config = robot.inverse_kinematics(
        approach_place_frame, approach_pick_config
    )
    part.attributes["approach_place_config"] = approach_place_config
    print(" [OK]")
    
    pre_approach_place_config = robot.inverse_kinematics(
        pre_approach_place_frame, approach_place_config
    )
    part.attributes["pre_approach_place_config"] = pre_approach_place_config

    print(" [OK]")


    print(" [  ] Place frame\r")
    if not last:
        place_config = robot.inverse_kinematics(place_frame, pre_approach_place_config)
    else:
        place_config = robot.inverse_kinematics(place_frame, approach_place_config)
    
    part.attributes["place_config"] = place_config
    
    last_approach_place_config = robot.inverse_kinematics(
        last_approach_place_frame, place_config)
    
    part.attributes["last_approach_place_config"] = last_approach_place_config
    print(" [OK]")

    print(" [  ] Pick path (before)\r")
    frames = [approach_pick_frame, pick_frame]
    pick_trajectory = robot.plan_cartesian_motion(
        frames,
        approach_pick_config,
        options=dict(
            max_step=0.01,
            avoid_collisions=True,
        ),
    )

    if pick_trajectory.fraction < 1.0:
        raise Exception("Found a pick trajectory but it is not complete")

    print(" [OK]")
    part.attributes["pick_trajectory"] = pick_trajectory

    print(" [  ] Pick path (after)\r")
    frames = [pick_frame, approach_pick_frame]

    # Create ACM with shape
    part_shape = get_part_shape(part_key)
    part_mesh = Mesh.from_shape(part_shape)
    

    ee_link_name = robot.attached_tool.link_name
    attach_frame = robot.attached_tool.frame.copy()
    
    ##Updated based on pickup and place algorithm
    print("a",attach_frame)
    attach_frame.xaxis.x *= -1
    #attach_frame.yaxis.y *= -1
    print("a1",attach_frame)
    t = Transformation.from_frame_to_frame(Frame([0,0,0],[1,0,0],[0,1,0]),Frame([0,0,0],[-1,0,0],[0,1,0]))
    part_mesh_t = part_mesh.transformed(t)
    
    part_acms = [AttachedCollisionMesh(CollisionMesh(part_mesh_t, 'brick', attach_frame), ee_link_name)]
    ##Updated based on pickup and place algorithm
    
    
    pick_trajectory_after = robot.plan_cartesian_motion(
        frames,
        pick_trajectory.points[-1],
        options=dict(
            max_step=0.01,
            avoid_collisions=True,
            attached_collision_meshes=part_acms,
        ),
    )

    if pick_trajectory_after.fraction < 1.0:
        raise Exception("Found a pick trajectory (after) but it is not complete")

    print(" [OK]")
    part.attributes["pick_trajectory_after"] = pick_trajectory_after
    
    # pre approach
    print(" [  ] Place path (pre)\r")
    frames = [approach_place_frame, pre_approach_place_frame]
    pre_place_trajectory = robot.plan_cartesian_motion(
        frames,
        approach_place_config,
        options=dict(
            max_step=0.01,
            avoid_collisions=True,
            attached_collision_meshes=part_acms,
        ),
    )

    if pre_place_trajectory.fraction < 1.0:
        raise Exception("Found a place trajectory but it is not complete")

    print(" [OK]")
    part.attributes["pre_place_trajectory"] = pre_place_trajectory
    
    
    
    print(" [  ] Place path (before)\r")
    if not last:
        frames = [pre_approach_place_frame, place_frame]
        place_trajectory = robot.plan_cartesian_motion(
            frames,
            pre_approach_place_config,
            options=dict(
                max_step=0.01,
                avoid_collisions=True,
                attached_collision_meshes=part_acms,
            ),
        )
    else:
        frames = [approach_place_frame, place_frame]
        place_trajectory = robot.plan_cartesian_motion(
            frames,
            approach_place_config,
            options=dict(
                max_step=0.01,
                avoid_collisions=True,
                attached_collision_meshes=part_acms,
            ),
        )

    if place_trajectory.fraction < 1.0:
        raise Exception("Found a place trajectory but it is not complete")

    print(" [OK]")
    part.attributes["place_trajectory"] = place_trajectory

    print(" [  ] Place path (after)\r")
    frames = [place_frame, last_approach_place_frame]
    place_trajectory_after = robot.plan_cartesian_motion(
        frames,
        place_trajectory.points[-1],
        options=dict(
            max_step=0.01,
            avoid_collisions=True,
        ),
    )

    if place_trajectory_after.fraction < 1.0:
        raise Exception("Found a place trajectory (after) but it is not complete")

    print(" [OK]")
    part.attributes["place_trajectory_after"] = place_trajectory_after
    
    print(" [  ] Place path (after up)\r")
    

    approach_place_frame_up = last_approach_place_frame.transformed(
        Translation.from_vector([0,0,0.1])
    )

    
    approach_place_config_up = robot.inverse_kinematics(
        approach_place_frame_up, last_approach_place_config
    )
    frames = [last_approach_place_frame, approach_place_frame_up]
    place_trajectory_after_up = robot.plan_cartesian_motion(
        frames,
        place_trajectory_after.points[-1],
        options=dict(
            max_step=0.01,
            avoid_collisions=True,
        ),
    )

    if place_trajectory_after_up.fraction < 1.0:
        raise Exception("Found a place trajectory (after up) but it is not complete")

    print(" [OK]")
    part.attributes["place_trajectory_after_up"] = place_trajectory_after_up
    

    
    print(" [  ] Free space path\r")
    goal_constraints = robot.constraints_from_configuration(
        approach_place_config,
        tolerances_above=get_tolerance_joints(),
        tolerances_below=get_tolerance_joints(),
    )

        
    failed_time = 0
    trajectory_count = 20
    best_traj = [math.radians(1)] * 50
    best_traj_count = 50
    while trajectory_count > 15:
        try:
            freespace_trajectory = robot.plan_motion(
                goal_constraints,
                approach_pick_config,
                options=dict(
                    planner_id=get_planner_id(),
                    attached_collision_meshes=part_acms,
                ),
            )
            
            print(" [OK]")
            trajectory_count = len(freespace_trajectory.points)
            print (trajectory_count)
            if trajectory_count > 15:
                failed_time +=1

            current_traj = freespace_trajectory
            current_count = trajectory_count
            if current_count < best_traj_count:
                best_traj_count = current_count
                best_traj = current_traj
            
        except:
            failed_time +=1
            freespace_trajectory = []
            
        if failed_time == 20:
            break
    print(failed_time)
    

    if freespace_trajectory == []:
        print(" [NO FREE]")
        part.attributes["freespace_trajectory"] = freespace_trajectory
    elif trajectory_count <= 15:
        print(" [GOOD]")
        part.attributes["freespace_trajectory"] = freespace_trajectory
    else:
        print(" [BAD]")
        print(best_traj_count)
        part.attributes["freespace_trajectory"] = best_traj
    
    
        
    print(" [  ] Free space path after\r")
    goal_constraints = robot.constraints_from_configuration(
        start_configuration,
        tolerances_above=get_tolerance_joints(),
        tolerances_below=get_tolerance_joints(),
    )

        
    failed_time_after = 0
    trajectory_count_after = 20
    best_traj_after = [math.radians(1)] * 50
    best_traj_count_after = 50
    while trajectory_count_after > 15:
        try:
            freespace_trajectory_after = robot.plan_motion(
                goal_constraints,
                approach_place_config_up,
                options=dict(
                    planner_id=get_planner_id(),
                    avoid_collisions=True,
                ),
            )
            
            print(" [OK]")
            trajectory_count_after = len(freespace_trajectory_after.points)
            print (trajectory_count_after)
            if trajectory_count_after > 15:
                failed_time_after +=1

            current_traj_after = freespace_trajectory_after
            current_count_after = trajectory_count_after
            if current_count_after < best_traj_count_after:
                best_traj_count_after = current_count_after
                best_traj_after = current_traj_after
            
        except:
            failed_time_after +=1
            freespace_trajectory_after = []
            
        if failed_time_after == 20:
            break
    print(failed_time_after)
    

    if freespace_trajectory_after == []:
        print(" [NO FREE]")
        part.attributes["freespace_trajectory_after"] = freespace_trajectory_after
    elif trajectory_count_after <= 15:
        print(" [GOOD]")
        part.attributes["freespace_trajectory_after"] = freespace_trajectory_after
    else:
        print(" [BAD]")
        print(best_traj_count_after)
        part.attributes["freespace_trajectory_after"] = best_traj_after
        
        
    print(" [  ] Start config path\r")
    goal_constraints = robot.constraints_from_configuration(
        approach_pick_config,
        tolerances_above=get_tolerance_joints(),
        tolerances_below=get_tolerance_joints(),
    )

    start_trajectory = robot.plan_motion(
        goal_constraints, start_configuration, options=dict(planner_id=get_planner_id())
    )
    print(" [OK]")
    part.attributes["start_trajectory"] = start_trajectory
    print()


scene = PlanningScene(robot)
scene.remove_collision_mesh("brick_wall")

client.close()
#
#compas.json_dump(
#    assembly,
#    os.path.join(HERE, "603_assembly_planning.json"),
#    pretty=True,
#)
#shapes = [Artist(mesh).draw() for mesh in check_mesh]
# ---------- end motion_planning_2 ----------

# ----
# RobotA
toggle_2 = BooleanToggle(False)
dam_2 = DataDam(DataA=toggle_2, BufferDelay=10000000, BufferMode=0)
motion_planning_3 = GhPythonScript(assembly=motion_planning_2.assembly, part_key=number_slider_3, last=toggle, send=dam_2)  # -> out, assembly, script
# ---------- motion_planning_3: Python ----------
import simple_comm as c
import simple_ur_script as ur
import imp
imp.reload(ur)

import math as m
import os
import time
import Rhino.Geometry as rg
import compas
from compas.robots import Configuration
from compas.topology import breadth_first_ordering
from compas_fab.backends import RosClient
from compas.robots import Configuration
from compas.topology import breadth_first_ordering
from compas.geometry import Translation
import copy
#client = RosClient("localhost")
#client.run()
#
#robot = client.load_robot()

assembly = assembly

script = ""
# script += ur.set_tcp_by_angles(float(-17.90), float(45.85), float(143.68), m.radians(0.0), m.radians(180.0), m.radians(90.0))
# script = c.concatenate_script(script)
# c.send_script(script,"192.168.10.10")

#trajectory_keys = ("start_trajectory",
#                   "pick_trajectory",
#                   "pick_trajectory_after",
#                   "freespace_trajectory",
#                   "place_trajectory",
#                   "place_trajectory_after",
#                   "freespace_trajectory_after",)
trajectory_keys = ("start_trajectory",
                   "pick_trajectory",
                   "freespace_trajectory",
                   "place_trajectory",
                   "freespace_trajectory_after",)
real_frames_keys = (
"approach_pick_frame_real",
"pick_frame_real",
"approach_place_frame_real",
"pre_approach_place_frame_real",
"place_frame_real",
"last_approach_place_frame_real"
)
# NOTE: Replace this with assembly.find_by_key after this is merged:
# https://github.com/compas-dev/compas/pull/1032

#script = ""
#script += ur.set_tcp_by_angles(float(-17.90), float(45.85), float(143.68), m.radians(0.0), m.radians(180.0), m.radians(90.0))


def from_ROS_to_UR(config):
    config_c = copy.deepcopy(config)
    if config_c[0] >= -3.14 * 2 and config_c[0] <= 3.14:
        config_c[0] = 3.14 + config_c[0]
    elif config_c[0] > 3.14:
        config_c[0] =  config_c[0] - 3.14
    return config_c

IO = 0
speed = 0.5  # rad/s
accel = 0.5  # rad/s^2
blendradius = 0.01 # <0.02m

part = assembly.graph.node_attribute(str(int(part_key)), "part")

#script += ur.move_l(rg.Plane(rg.Point3d(300,100,414),rg.Vector3d(-1,0,0),rg.Vector3d(0,1,0)),accel*0.1,speed*0.1)
#script += ur.move_l(rg.Plane(rg.Point3d(300,100,364),rg.Vector3d(-1,0,0),rg.Vector3d(0,1,0)),accel*0.1,speed*0.1)

for traj_name in trajectory_keys:
    traj = part.attributes[traj_name]
    length = len(traj.points)
    print int(part_key)
    if traj_name == "start_trajectory":
        for i in [0,-1]:
            config = traj.points[i].joint_values
            script += ur.move_j(config, accel, speed)
    
    elif traj_name == "pick_trajectory":
        script += ur.move_l_compas(part.attributes["approach_pick_frame_real"],accel*0.1,speed*0.1)
        script += ur.move_l_compas(part.attributes["pick_frame_real"],accel*0.1,speed*0.1)
        script += ur.set_digital_out(IO, True) 
        script += ur.sleep(3)
        script += ur.move_l_compas(part.attributes["approach_pick_frame_real"],accel*0.1,speed*0.1)
    
    elif traj_name == "freespace_trajectory" or traj_name == "freespace_trajectory_after":
        for i in range(length):
            config = traj.points[i].joint_values
            script += ur.move_j_blend(config, accel, speed,0, blendradius)
            
    elif traj_name == "place_trajectory":
        if not last:
            script += ur.move_l_compas(part.attributes["approach_place_frame_real"],accel*0.1,speed*0.1)
            script += ur.move_l_compas(part.attributes["pre_approach_place_frame_real"],accel*0.1,speed*0.1)
            script += ur.move_l_compas(part.attributes["place_frame_real"],accel*0.1,speed*0.1)

            if int(part_key) == 9 :
                script += ur.popup_stop("4mm up", "release after next put")
                frame = part.attributes["place_frame_real"]
                T_t = Translation.from_vector(frame.yaxis*(-0.004))
                frame_t = frame.transformed(T_t)
                script += ur.move_l_compas(frame_t,accel*0.03,speed*0.03)
                
            script += ur.popup_stop("release", "release after next put")
            script += ur.set_digital_out(IO, False)
            script += ur.sleep(1)
            script += ur.move_l_compas(part.attributes["last_approach_place_frame_real"],accel*0.1,speed*0.1)
        else:
            script += ur.move_l_compas(part.attributes["last_approach_place_frame_real"],accel*0.1,speed*0.1)
            frame = part.attributes["place_frame_real"]
            T_t = Translation.from_vector(frame.yaxis*(-0.001))
            frame_t = frame.transformed(T_t)
            script += ur.move_l_compas(frame_t,accel*0.1,speed*0.1)
            script += ur.move_l_compas(part.attributes["place_frame_real"],accel*0.1,speed*0.1)
            
            script += ur.popup_stop("hold on", "release after next put")
            script += ur.set_digital_out(IO, False)
            script += ur.sleep(1)
            script += ur.move_l_compas(part.attributes["last_approach_place_frame_real"],accel*0.1,speed*0.1)
        

#configuration = robot.zero_configuration()
#configuration.joint_values = config
#pick_frame = robot.forward_kinematics(configuration)
#print pick_frame
script = c.concatenate_script(script)
if send:
    c.send_script(script,"192.168.10.10")



print("Finished.")
# ---------- end motion_planning_3 ----------
mesh_16 = Mesh(assembly_visualization_4.blocks)
mesh_17 = Mesh(assembly_visualization_4.supports)
demesh = DeconstructMesh(Mesh=mesh_16)  # -> Vertices, Faces, Colours, Normals
demesh_2 = DeconstructMesh(Mesh=mesh_17)  # -> Vertices, Faces, Colours, Normals
conmesh = ConstructMesh(Vertices=demesh.Vertices, Faces=demesh.Faces)
conmesh_2 = ConstructMesh(Vertices=demesh_2.Vertices, Faces=demesh_2.Faces)
connect = BooleanToggle(True)
panel_9 = Panel(motion_planning_3.script)
connect_2 = BooleanToggle(True)
preview = CustomPreview(Geometry=conmesh, Material=ColourSwatch(SwatchColor=RGBA(75, 189, 170, 130)))
preview_2 = CustomPreview(Geometry=conmesh_2, Material=ColourSwatch(SwatchColor=RGBA(37, 105, 232, 144)))
ros = ROSConnect(connect=connect)  # -> ros_client, is_connected; inputs port: Int32, connect: Boolean
#   port ip: The ip address ROS. Defaults to 127.0.0.1.
#   port port: The port of ROS. Defaults to 9090.
#   port connect: If True, connects to ROS. If False, disconnects from ROS. Defaults to False.
#   port ros_client: The ROS client.
#   port is_connected: True if connection established.
# ---------- ros: Python ----------
"""
Connect or disconnect to ROS.

COMPAS FAB v0.22.0
"""
from ghpythonlib.componentbase import executingcomponent as component
from scriptcontext import sticky as st

from compas_fab.backends import RosClient
from compas_fab.ghpython.components import create_id


class ROSConnect(component):
    def RunScript(self, ip, port, connect):
        ros_client = None

        ip = ip or '127.0.0.1'
        port = port or 9090

        key = create_id(self, 'ros_client')
        ros_client = st.get(key, None)

        if ros_client:
            st[key].close()
        if connect:
            st[key] = RosClient(ip, port)
            st[key].run(5)

        ros_client = st.get(key, None)
        is_connected = ros_client.is_connected if ros_client else False
        return (ros_client, is_connected)
# ---------- end ros ----------
ros_2 = ROSConnect(connect=connect_2)  # -> ros_client, is_connected; inputs port: Int32, connect: Boolean; same code as ros
load_robot = BooleanToggle(True)
load_robot_2 = BooleanToggle(True)
# 3. UR Robot Visualization
robot = ROSRobot(ros_client=ros.ros_client, load=load_robot)  # -> robot; inputs load: Boolean
#   port ros_client: The ROS client.
#   port load: If True, loads the robot from ROS. Defaults to False.
# ---------- robot: Python ----------
"""
Load robot directly from ROS.

COMPAS FAB v0.22.0
"""
from compas_ghpython.artists import RobotModelArtist
from ghpythonlib.componentbase import executingcomponent as component
from scriptcontext import sticky as st

from compas_fab.ghpython.components import create_id


class ROSRobot(component):
    def RunScript(self, ros_client, load):
        key = create_id(self, 'robot')

        if ros_client and ros_client.is_connected and load:
            # Load URDF from ROS
            st[key] = ros_client.load_robot(load_geometry=True, precision='12f')
            st[key].artist = RobotModelArtist(st[key].model)

        robot = st.get(key, None)
        if robot:  # client sometimes need to be restarted, without needing to reload geometry
            robot.client = ros_client
        return robot
# ---------- end robot ----------
load = GhPythonScript(assembly=motion_planning_2.assembly, robot=robot, reload=Button())  # -> robot, assembly
# ---------- load: Python ----------
import compas
from compas_fab.robots import Tool

if 'tool' in assembly.attributes:
    tool = Tool.from_data(assembly.attributes['tool'])
    robot.attach_tool(tool)
# ---------- end load ----------
load_plans = GhPythonScript(assembly=load.assembly, part=number_slider_3, i=Slider(37, range=0..80), last=toggle)  # -> total, config, acms
# ---------- load_plans: Python ----------
if not last:
    trajectory_keys = ("start_trajectory",
                       "pick_trajectory",
                       "pick_trajectory_after",
                       "freespace_trajectory",
                       "pre_place_trajectory",
                       "place_trajectory",
                       "place_trajectory_after",
                       "place_trajectory_after_up",
                       "freespace_trajectory_after",)
else:
    trajectory_keys = ("start_trajectory",
                       "pick_trajectory",
                       "pick_trajectory_after",
                       "freespace_trajectory",
                       "place_trajectory",
                       "place_trajectory_after",
                       "place_trajectory_after_up",
                       "freespace_trajectory_after",)
                       

# NOTE: Replace this with assembly.find_by_key after this is merged:
# https://github.com/compas-dev/compas/pull/1032
part = assembly.graph.node_attribute(str(int(part)), "part")

lbound = 0
ubound = 0
i = int(i)
total = sum([len(part.attributes[traj_name].points) for traj_name in trajectory_keys])
if i >= total:
    raise Exception('Max number of trajectory points is ' + str(total))
    
for traj_name in trajectory_keys:
    traj = part.attributes[traj_name]
    ubound += len(traj.points)

    if i >= ubound:
        lbound = ubound
        continue

    config = traj.points[i - lbound]
    acms = traj.attached_collision_meshes
    break
# ---------- end load_plans ----------
# 3. UR Robot Visualization
robot_2 = ROSRobot(ros_client=ros_2.ros_client, load=load_robot_2)  # -> robot; inputs load: Boolean; same code as robot
robot_visualize = RobotVisualize(
    robot=load.robot,
    configuration=load_plans.config,
    attached_collision_meshes=load_plans.acms,
    show_frames=True,
    show_acm=True)  # -> visual, collision, attached_meshes, frames, base_frame, ee_frame; inputs attached_collision_meshes: list, show_visual: Boolean, show_collision: Boolean, show_frames: Boolean, show_base_frame: Boolean, show_end_effector_frame: Boolean, show_acm: Boolean
#   port group: The planning group used for end-effector and base visualization.
#   port configuration: The robot's full configuration.
#   port attached_collision_meshes: A list of attached collision meshes.
#   port show_visual: Whether or not to show the robot's visual meshes.
#   port show_collision: Whether or not to show the robot's collision meshes.
#   port show_frames: Whether or not to show the robot's joint frames.
#   port show_base_frame: Whether or not to show the robot's base frame.
#   port show_end_effector_frame: Whether or not to show the robot's end-effector frame.
#   port show_acm: Whether or not to show the attached collision meshes (if any).
#   port visual: The robot's visual Rhino meshes (if any).
#   port collision: The robot's collision Rhino meshes (if any).
#   port attached_meshes: The attached collision Rhino meshes (if any).
#   port frames: The robot's joint frames as Rhino planes (if any).
#   port base_frame: The robot's base frame as a Rhino plane (if any).
#   port ee_frame: The robot's end-effector frame as a Rhino plane (if any).
# ---------- robot_visualize: Python ----------
"""
Visualizes the robot.

COMPAS FAB v0.22.0
"""
from compas.geometry import Transformation
from compas_ghpython.artists import FrameArtist
from compas_ghpython.artists import MeshArtist
from ghpythonlib.componentbase import executingcomponent as component


class RobotVisualize(component):
    def RunScript(self, robot, group, configuration, attached_collision_meshes, show_visual, show_collision,
                  show_frames, show_base_frame, show_end_effector_frame, show_acm):

        visual = None
        collision = None
        attached_meshes = None
        frames = None
        base_frame = None
        ee_frame = None

        if robot:
            show_visual = True if show_visual is None else show_visual
            configuration = configuration or robot.zero_configuration()

            robot.update(configuration, visual=show_visual, collision=show_collision)
            compas_frames = robot.transformed_frames(configuration, group)

            if show_visual:
                visual = robot.artist.draw_visual()

            if show_collision:
                collision = robot.artist.draw_collision()

            if show_base_frame:
                base_compas_frame = compas_frames[0]
                artist = FrameArtist(base_compas_frame)
                base_frame = artist.draw()

            if show_end_effector_frame:
                ee_compas_frame = robot.forward_kinematics(configuration, group, options=dict(solver='model'))
                artist = FrameArtist(ee_compas_frame)
                ee_frame = artist.draw()

            if show_frames:
                frames = []
                for compas_frame in compas_frames[1:]:
                    artist = FrameArtist(compas_frame)
                    frame = artist.draw()
                    frames.append(frame)

            if show_acm:
                attached_meshes = []
                for acm in attached_collision_meshes:
                    frame = robot.forward_kinematics(configuration, options=dict(solver='model', link=acm.link_name))
                    T = Transformation.from_frame_to_frame(acm.collision_mesh.frame, frame)
                    mesh = acm.collision_mesh.mesh.transformed(T)
                    attached_meshes.append(MeshArtist(mesh).draw())

        return (visual, collision, attached_meshes, frames, base_frame, ee_frame)
# ---------- end robot_visualize ----------
refresh = Button()
refresh_2 = Button()
built_assembly = GhPythonScript(assembly=load.assembly, current_part=number_slider_3, only_until_current=Toggle(True))  # -> a
# ---------- built_assembly: Python ----------
from compas.artists import Artist
from compas.topology import breadth_first_ordering

a = []

root_part_key = "0"
sequence = breadth_first_ordering(assembly.graph.adjacency, root_part_key)
current_part = str(int(current_part))

for part_key in sequence:
    part = assembly.graph.node_attribute(part_key, "part")
    if only_until_current and str(part_key) == current_part:
        break
    mesh = part.geometry
    artist = Artist(mesh)
    a.append(artist.draw())
# ---------- end built_assembly ----------
planning_scene = GhPythonScript(robot=load.robot, refresh=refresh)  # -> a
# ---------- planning_scene: Python ----------
from compas_fab.robots import PlanningScene

from compas.artists import Artist
from compas.geometry import Frame
from compas.geometry import Transformation


scene = PlanningScene(robot)

collision_meshes = []
attached_collision_meshes = []

configuration = robot.zero_configuration()
scene = robot.client.get_planning_scene()

for co in scene.world.collision_objects:
    header = co.header
    frame_id = header.frame_id
    cms = co.to_collision_meshes()

    for cm in cms:
        if cm.frame != Frame.worldXY():
            t = Transformation.from_frame(cm.frame)
            mesh = cm.mesh.transformed(t)
        else:
            mesh = cm.mesh

        collision_meshes.append(mesh)

    for aco in scene.robot_state.attached_collision_objects:
        for acm in aco.to_attached_collision_meshes():
            frame_id = aco.object["header"]["frame_id"]
            frame = robot.forward_kinematics(configuration, options=dict(link=frame_id))
            t = Transformation.from_frame(frame)

            # Local CM frame
            if (acm.collision_mesh.frame and acm.collision_mesh.frame != Frame.worldXY()):
                t = t * Transformation.from_frame(acm.collision_mesh.frame)

            mesh = acm.collision_mesh.mesh.transformed(t)

            attached_collision_meshes.append(mesh)

a = []
for cm in collision_meshes + attached_collision_meshes:
    a.append(Artist(cm).draw_mesh())
# ---------- end planning_scene ----------
ros_endfector = Geometry(robot_visualize.attached_meshes)
ros_robot = Geometry(robot_visualize.visual)
geo_3 = Geometry(robot_visualize.collision)
geo_4 = Geometry(built_assembly)
panel_11 = Panel("""5.4237
-0.5830
0.9796
-5.0908
1.5535
3.8400""")
ros_geometry = Geometry([ros_robot, ros_endfector])
rad_3 = Radians(Degrees="15")
deg = Degrees(Radians=panel_11)
rotate_9 = Rotate(Geometry=ros_geometry, Angle=degrees(Slider(180, range=0..1000)), Plane=PlaneXY(0, 0, 0))  # -> Geometry, Transform
panel_12 = Panel(rad_3)
series = Series(Start=Slider(-5, range=-10..0), Step=Slider(1, range=0..1), Count=Slider(5, range=0..10))
panel_13 = Panel(deg)
item = ListItem(List=ros_robot, Index=series, Wrap=True)  # disabled
orient_3 = Orient(Geometry=item, Source=pl_3pt_2, Target=pl_3pt)  # -> Geometry, Transform; disabled
motion_planning_4 = GhPythonScript(
    assembly=linear_sequence_2.assembly,
    part_keyvalue=subtraction_3,
    all=Toggle(False),
    collision_robots=orient_3.Geometry,
    T=dualrobotstransform5pt.T)  # -> out, assembly; inputs collision_robots: list of Mesh
# ---------- motion_planning_4: Python ----------
import math
import os
from compas_fab.backends import RosClient
from compas_fab.robots import AttachedCollisionMesh
from compas_fab.robots import CollisionMesh
from compas_fab.robots import PlanningScene
from compas_fab.robots import Tool
from compas.geometry import Transformation
from compas_rhino.conversions import RhinoMesh
import compas
from compas.datastructures import Mesh
from compas.geometry import Box
from compas.geometry import Frame
from compas.geometry import Vector
from compas.geometry import Translation
from compas.geometry import Scale
from compas.topology import breadth_first_ordering
import Grasshopper as gh
from compas.artists import Artist


assembly = assembly
Tinv = T.inverse()

def from_real_to_ROS(geo):
    T_from_real_to_ROS = Transformation.from_euler_angles([0,0,math.pi])
    ROS_geo = geo.transformed(T_from_real_to_ROS)
    return ROS_geo

def from_ROS_to_real(geo):
    T_from_ROS_to_real = Transformation.from_euler_angles([0,0,-math.pi])
    real_geo = geo.transformed(T_from_ROS_to_real)
    return real_geo
    
def get_tool():
    current_folder =os.path.dirname(ghdoc.Path)
    mesh = Mesh.from_stl(os.path.join(current_folder, "vacuum_suction_simplified.stl"))
    #mesh = Mesh.from_stl("vacuum_suction_simplified.stl")#0.078
    #mesh = Mesh.from_stl("vacuum_gripper_simplified.stl")#0.064
    frame = Frame([0.0, 0.0, 0.0775], [1, 0, 0], [0, 1, 0])
    #frame = Frame([-0.00042, -0.00070, 0.078], [1, 0, 0], [0, 1, 0])
    tool = Tool(mesh, frame, link_name="wrist_3_link")
    return tool


def get_approach_vector(part_key):
    part = assembly.graph.node_attribute(part_key, "part")
    ROS_frame = from_real_to_ROS(part.frame)
    approach_vector = ROS_frame.zaxis.scaled(-0.1)
    return approach_vector

def get_pick_frame(part_key):
    #frame = Frame((-0.3, -0.4, 0.010), (-1, 0, 0), (0, 1, 0))
    #frame = Frame((-0.3, -0.1, 0.010), (-1, 0, 0), (0, 1, 0))
    frame = Frame((0.3, 0.1, 0.362), (1, 0, 0), (0, 1, 0))
    ROS_frame = from_real_to_ROS(frame)
    print ROS_frame
    frame_t = ROS_frame.transformed(Tinv)
    print frame_t
    return frame_t

def get_hold_frame(part_key):
    part = assembly.graph.node_attribute(part_key, "part")
    ROS_frame = from_real_to_ROS(part.frame)
    return ROS_frame

def prepare_scene(robot,collision_robots, part_key):
    scene = PlanningScene(robot)
    box = Box.from_diagonal([(-0.7, -0.7, -0.010), (0.7, 0.7, -0.03)])
    mesh = Mesh.from_shape(box)
    mesh_ROS = from_real_to_ROS(mesh)
    mesh_t = mesh_ROS.transformed(Tinv)
    #scene.add_collision_mesh(CollisionMesh(mesh_t, "floor"))

    for k in get_part_sequence():
        if part_key == k:
            break

        part = assembly.graph.node_attribute(k, "part")
        mesh = Mesh.from_shape(part.shape)
        
        S = Scale.from_factors([0.99]*3,Frame([0,0,0],[1,0,0],[0,1,0]))
        mesh_scaled = mesh.transformed(S)
        part_ROS_frame = from_real_to_ROS(part.frame)
        
        scene.append_collision_mesh(CollisionMesh(mesh_scaled, "brick_wall", frame=part_ROS_frame))
        t = Transformation.from_frame_to_frame(Frame([0,0,0],[1,0,0],[0,1,0]),part_ROS_frame)


def get_start_configuration(robot):
    config = robot.zero_configuration()
    #config.joint_values = (-0.306, 4.351, 2.231, -2.869, 4.712, 1.465)
    #config.joint_values = (0.489, -1.77, 2.15, -2.869,-0.875, -0.575)
    #config.joint_values = (-1.878,-1.682,2.139,-2.01,-1.556,-0.313) #for pick
    #config.joint_values = (-0.238,-1.445,2.20,-2.02,-1.47,3.60)
    #config.joint_values = (0.1994,-0.6897,1.1363,-0.4465,3.3447,0.5236) #for hold
    config.joint_values = (-1.15584,-1.54828,2.38291,-0.86082,0.44444,0.77033) #for hold
    #config.joint_values = (5.4237-3.1415,-0.5830,0.9796,-5.0908,1.5535,3.8400)
    #config.joint_values = (4.593,-1.072,1.724,-2.224,1.568,1.21)
    
    return config


def get_part_shape(part_key):
    part = assembly.graph.node_attribute(part_key, "part")
    return part.shape


def get_part_sequence():
    root_part_key = "0"
    sequence = breadth_first_ordering(assembly.graph.adjacency, root_part_key)
    return sequence


def get_tolerance_joints():
    return [math.radians(1)] * 6


def get_planner_id():
    #return "TRRT"
    return "RRT"
    #return "RRT*"
    
    
    
trajectory_keys = ("freespace_trajectory",
                   "hold_trajectory",
                   "hold_trajectory_after",
                   "freespace_trajectory_after",)
real_frame_keys = ("approach_hold_frame_real",
                   "hold_frame_real",)
# PICK & PLACE PROCEDURE

def adjust_to_attached_tool(robot, frame):
    if not robot.attached_tool:
        return frame
    return robot.from_tcf_to_t0cf([frame])[0]


client = RosClient("localhost")
client.run()

robot = client.load_robot()

start_configuration = get_start_configuration(robot)

tool = get_tool()
if tool:
    robot.attach_tool(tool)

assembly.attributes['start_configuration'] = start_configuration.data
assembly.attributes['tool'] = tool.data
check_mesh = []
#for part_key in get_part_sequence():

if all:
    a = 1
    b = 11
else:
    a = int(part_keyvalue)
    b = a + 1
    
for part_key in get_part_sequence()[a:b]:   # NOTE: For quick testing, only take the first few parts in the sequence
    part = assembly.graph.node_attribute(part_key, "part")

    scene = PlanningScene(robot)
    scene.reset()
    prepare_scene(robot, collision_robots,part_key)

    print("Part {}\n--------".format(part_key))
    print(" [  ] Hold frame + approach vector reachability\r")
    hold_frame = adjust_to_attached_tool(robot, get_hold_frame(part_key))
    hold_frame_real = from_ROS_to_real(hold_frame)
    part.attributes["hold_frame_real"] = hold_frame_real
    
    approach_hold_frame = hold_frame.transformed(
        Translation.from_vector(- hold_frame.normal * 0.05)
    )
    approach_hold_frame_real = from_ROS_to_real(approach_hold_frame)
    part.attributes["approach_hold_frame_real"] = approach_hold_frame_real
    
    approach_hold_config = robot.inverse_kinematics(
        approach_hold_frame, start_configuration
    )
    part.attributes["approach_hold_config"] = approach_hold_config
    print(" [OK]")

    print(" [  ] Hold frame\r")
    hold_config = robot.inverse_kinematics(hold_frame, approach_hold_config)
    part.attributes["hold_config"] = hold_config
    print(" [OK]")


    # 0. Start config to hold_approach
    print(" [0] Free space path\r")
    goal_constraints = robot.constraints_from_configuration(
        approach_hold_config,
        tolerances_above=get_tolerance_joints(),
        tolerances_below=get_tolerance_joints(),
    )

        
    failed_time = 0
    trajectory_count = 20
    best_traj = [math.radians(1)] * 50
    best_traj_count = 50
    while trajectory_count > 15:
        try:
            freespace_trajectory = robot.plan_motion(
                goal_constraints,
                start_configuration,
                options=dict(
                    planner_id=get_planner_id(),
                    avoid_collisions=True,
                ),
            )
            
            print(" [OK]")
            trajectory_count = len(freespace_trajectory.points)
            print (trajectory_count)
            if trajectory_count > 15:
                failed_time +=1

            current_traj = freespace_trajectory
            current_count = trajectory_count
            if current_count < best_traj_count:
                best_traj_count = current_count
                best_traj = current_traj
            
        except:
            failed_time +=1
            freespace_trajectory = []
            
        if failed_time == 20:
            break
    print(failed_time)
    

    if freespace_trajectory == []:
        print(" [NO FREE]")
        part.attributes["freespace_trajectory"] = freespace_trajectory
    elif trajectory_count <= 15:
        print(" [GOOD]")
        part.attributes["freespace_trajectory"] = freespace_trajectory
    else:
        print(" [BAD]")
        print(best_traj_count)
        part.attributes["freespace_trajectory"] = best_traj
    
    print(part.attributes["freespace_trajectory"].points[0].joint_values)

    # 1. Hold approach to hold
    print(" [1] Hold path (before)\r")
    frames = [approach_hold_frame, hold_frame]
    hold_trajectory = robot.plan_cartesian_motion(
        frames,
        approach_hold_config,
        options=dict(
            max_step=0.01,
            avoid_collisions=True,
        ),
    )

    if hold_trajectory.fraction < 1.0:
        raise Exception("Found a hold trajectory but it is not complete")

    print(" [OK]")
    part.attributes["hold_trajectory"] = hold_trajectory


    # 2. hold to hold approach
    print(" [2] Hold path (after)\r")
    frames = [hold_frame, approach_hold_frame]
    hold_trajectory_after = robot.plan_cartesian_motion(
        frames,
        hold_config,
        options=dict(
            max_step=0.01,
            avoid_collisions=True,
        ),
    )

    if hold_trajectory_after.fraction < 1.0:
        raise Exception("Found a hold trajectory after but it is not complete")
    
    print(" [OK]")
    part.attributes["hold_trajectory_after"] = hold_trajectory_after


    # 3. Hold approach back to start config
    print(" [3] Free space path after\r")
    goal_constraints = robot.constraints_from_configuration(
        start_configuration,
        tolerances_above=get_tolerance_joints(),
        tolerances_below=get_tolerance_joints(),
    )

        
    failed_time_after = 0
    trajectory_count_after = 20
    best_traj_after = [math.radians(1)] * 50
    best_traj_count_after = 50
    while trajectory_count_after > 15:
        try:
            freespace_trajectory_after = robot.plan_motion(
                goal_constraints,
                approach_hold_config,
                options=dict(
                    planner_id=get_planner_id(),
                    avoid_collisions=True,
                ),
            )
            
            print(" [OK]")
            trajectory_count_after = len(freespace_trajectory_after.points)
            print (trajectory_count_after)
            if trajectory_count_after > 15:
                failed_time_after +=1

            current_traj_after = freespace_trajectory_after
            current_count_after = trajectory_count_after
            if current_count_after < best_traj_count_after:
                best_traj_count_after = current_count_after
                best_traj_after = current_traj_after
            
        except:
            failed_time_after +=1
            freespace_trajectory_after = []
            
        if failed_time_after == 20:
            break
    print(failed_time_after)
    

    if freespace_trajectory_after == []:
        print(" [NO FREE]")
        part.attributes["freespace_trajectory_after"] = freespace_trajectory_after
    elif trajectory_count_after <= 15:
        print(" [GOOD]")
        part.attributes["freespace_trajectory_after"] = freespace_trajectory_after
    else:
        print(" [BAD]")
        print(best_traj_count_after)
        part.attributes["freespace_trajectory_after"] = best_traj_after

scene = PlanningScene(robot)
scene.remove_collision_mesh("brick_wall")

client.close()
#
#compas.json_dump(
#    assembly,
#    os.path.join(HERE, "603_assembly_planning.json"),
#    pretty=True,
#)
#shapes = [Artist(mesh).draw() for mesh in check_mesh]
# ---------- end motion_planning_4 ----------

# ----
# robotB
toggle_3 = BooleanToggle(False)
dam_3 = DataDam(DataA=toggle_3, BufferDelay=10000000, BufferMode=0)
motion_planning_5 = GhPythonScript(assembly=motion_planning_4.assembly, part_key=subtraction_3, send=dam_3)  # -> out, assembly, script, pick_frame
# ---------- motion_planning_5: Python ----------
import simple_comm as c
import simple_ur_script as ur
import imp
imp.reload(ur)

import math as m
import os
import time
import Rhino.Geometry as rg
import compas
from compas_fab.backends import RosClient
from compas.robots import Configuration
from compas.topology import breadth_first_ordering

client = RosClient("localhost")
client.run()

robot = client.load_robot()

assembly = assembly

def from_ROS_to_UR(config):
    config_c = copy.deepcopy(config)
    if config_c[0] >= -3.14 * 2 and config_c[0] <= 3.14:
        config_c[0] = 3.14 + config_c[0]
    elif config_c[0] > 3.14:
        config_c[0] =  config_c[0] - 3.14
    return config_c
    
    

script = ""
# script += ur.set_tcp_by_angles(float(-17.90), float(45.85), float(143.68), m.radians(0.0), m.radians(180.0), m.radians(90.0))
# script = c.concatenate_script(script)
# c.send_script(script,"192.168.10.10")

#trajectory_keys = ("freespace_trajectory",
#                   "hold_trajectory",
#                   "hold_trajectory_after",
#                   "freespace_trajectory_after",)
#trajectory_keys = ("freespace_trajectory",
#                   "hold_trajectory",
#                   "freespace_trajectory_after",)
trajectory_keys = ("hold_trajectory",)
real_frame_keys = ("approach_hold_frame_real",
                   "hold_frame_real",)
# NOTE: Replace this with assembly.find_by_key after this is merged:
# https://github.com/compas-dev/compas/pull/1032

#script = ""
#script += ur.set_tcp_by_angles(float(-17.90), float(45.85), float(143.68), m.radians(0.0), m.radians(180.0), m.radians(90.0))




IO = 0
speed = 0.5  # rad/s
accel = 0.5  # rad/s^2
blendradius = 0.01 # <0.02m

part = assembly.graph.node_attribute(str(int(part_key)), "part")

for traj_name in trajectory_keys:
    traj = part.attributes[traj_name]
    length = len(traj.points)

    if traj_name == "hold_trajectory":
        script += ur.move_l_compas(part.attributes["approach_hold_frame_real"],accel*0.1,speed*0.1)
        script += ur.move_l_compas(part.attributes["hold_frame_real"],accel*0.1,speed*0.1)
        script += ur.set_digital_out(IO, True)
        script += ur.popup_stop("hold on", "release after next put")
        script += ur.set_digital_out(IO, False)
        script += ur.sleep(1)
        script += ur.move_l_compas(part.attributes["approach_hold_frame_real"],accel*0.1,speed*0.1)
        
    elif traj_name == "freespace_trajectory" or traj_name == "freespace_trajectory_after":
        for i in range(length):
            config = traj.points[i].joint_values
            script += ur.move_j_blend(config, accel, speed,0, blendradius)

#        config = traj.points[-1].joint_values
#        #nowait = False
#        script += ur.move_j_blend(config, accel, speed,0, blendradius)

#print pick_frame
script = c.concatenate_script(script)
if send:
    c.send_script(script,"192.168.10.12")



print("Finished.")
# ---------- end motion_planning_5 ----------

# ----
# robot B + tilted calibration
toggle_4 = BooleanToggle(False)
dam_4 = DataDam(DataA=toggle_4, BufferDelay=10000000, BufferMode=0)
motion_planning_6 = GhPythonScript(assembly=motion_planning_4.assembly, part_key=subtraction_3, send=dam_4, angle_list=panel_4)  # -> out, assembly, script, pick_frame, frame_rhino_1, frame_rhino_2, frame_rhino_4; inputs angle_list: list
# ---------- motion_planning_6: Python ----------
import simple_comm as c
import simple_ur_script as ur
import imp
imp.reload(ur)

import math as m
import os
import time
import Rhino.Geometry as rg
import compas
from compas.geometry import Transformation,Translation,Rotation
from compas_fab.backends import RosClient
from compas.robots import Configuration
from compas.topology import breadth_first_ordering
from compas_rhino import conversions

client = RosClient("localhost")
client.run()

robot = client.load_robot()

assembly = assembly

def from_ROS_to_UR(config):
    config_c = copy.deepcopy(config)
    if config_c[0] >= -3.14 * 2 and config_c[0] <= 3.14:
        config_c[0] = 3.14 + config_c[0]
    elif config_c[0] > 3.14:
        config_c[0] =  config_c[0] - 3.14
    return config_c
    
    

script = ""
# script += ur.set_tcp_by_angles(float(-17.90), float(45.85), float(143.68), m.radians(0.0), m.radians(180.0), m.radians(90.0))
# script = c.concatenate_script(script)
# c.send_script(script,"192.168.10.10")

#trajectory_keys = ("freespace_trajectory",
#                   "hold_trajectory",
#                   "hold_trajectory_after",
#                   "freespace_trajectory_after",)
#trajectory_keys = ("freespace_trajectory",
#                   "hold_trajectory",
#                   "freespace_trajectory_after",)
trajectory_keys = ("hold_trajectory",)
real_frame_keys = ("approach_hold_frame_real",
                   "hold_frame_real",)
# NOTE: Replace this with assembly.find_by_key after this is merged:
# https://github.com/compas-dev/compas/pull/1032

#script = ""
#script += ur.set_tcp_by_angles(float(-17.90), float(45.85), float(143.68), m.radians(0.0), m.radians(180.0), m.radians(90.0))





IO = 0
speed = 0.5  # rad/s
accel = 0.5  # rad/s^2
blendradius = 0.01 # <0.02m

part = assembly.graph.node_attribute(str(int(part_key)), "part")

for traj_name in trajectory_keys:
    traj = part.attributes[traj_name]
    length = len(traj.points)

    if traj_name == "hold_trajectory":
        script += ur.move_l_compas(part.attributes["approach_hold_frame_real"],accel*0.1,speed*0.1)
        frame = part.attributes["hold_frame_real"]
        if int(part_key) == 9:
            T_t = Translation.from_vector(frame.yaxis * (-0.004))
            frame_t = frame.transformed(T_t)
        else:
            frame_t = frame
            
        script += ur.move_l_compas(frame_t,accel*0.1,speed*0.1)
        script += ur.set_digital_out(IO, True)
        script += ur.popup_stop("next step is to rotate half", "release after next put")
        
        T_z =  Translation.from_vector(frame_t.zaxis*0.078)
        frame_z = frame_t.transformed(T_z)
        
        angle = angle_list[int(part_key)]

        T_rotate_1 = Rotation.from_axis_and_angle(frame_z.xaxis, angle/2, frame_z.point)
        T_rotate_2 = Rotation.from_axis_and_angle(frame_z.xaxis, angle, frame_z.point)
        frame_adjust_1 = frame_z.transformed(T_rotate_1)
        frame_adjust_2 = frame_z.transformed(T_rotate_2)
        frame_rhino_1 = conversions.frame_to_rhino(frame_adjust_1)
        frame_rhino_2 = conversions.frame_to_rhino(frame_adjust_2)
        
        T_z_after_1 =  Translation.from_vector( - frame_adjust_1.zaxis*0.078)
        T_z_after_2 =  Translation.from_vector( - frame_adjust_2.zaxis*0.078)
        
        frame_adjust_3 = frame_adjust_1.transformed(T_z_after_1)
        frame_adjust_4 = frame_adjust_2.transformed(T_z_after_2)
        frame_rhino_4 = conversions.frame_to_rhino(frame_adjust_4)
        
        script += ur.move_l_compas(frame_adjust_3,accel*0.03,speed*0.03)
        
#        script += ur.popup_stop("next step is to rotate full", "release after next put")
#        
#        script += ur.move_l_compas(frame_adjust_4,accel*0.03,speed*0.03)
        
        if int(part_key) == 9:
            T_z =  Translation.from_vector(frame.zaxis*0.078)
            frame_z = frame.transformed(T_z)
            
            angle = angle_list[int(part_key)]
    
            T_rotate_1 = Rotation.from_axis_and_angle(frame_z.xaxis, angle/2, frame_z.point)
            T_rotate_2 = Rotation.from_axis_and_angle(frame_z.xaxis, angle, frame_z.point)
            frame_adjust_1 = frame_z.transformed(T_rotate_1)
            frame_adjust_2 = frame_z.transformed(T_rotate_2)
            frame_rhino_1 = conversions.frame_to_rhino(frame_adjust_1)
            frame_rhino_2 = conversions.frame_to_rhino(frame_adjust_2)
            
            T_z_after_1 =  Translation.from_vector( - frame_adjust_1.zaxis*0.078)
            T_z_after_2 =  Translation.from_vector( - frame_adjust_2.zaxis*0.078)
            
            frame_adjust_3 = frame_adjust_1.transformed(T_z_after_1)
            frame_adjust_4 = frame_adjust_2.transformed(T_z_after_2)
            frame_adjust_4_9 = frame_adjust_4
            frame_adjust_3_9 = frame_adjust_3
            
            script += ur.popup_stop("move to final piece", "release after next put")
            script += ur.move_l_compas(frame_adjust_3_9,accel*0.03,speed*0.03)
            script += ur.popup_stop("move to original real", "release after next put")
            script += ur.move_l_compas(frame,accel*0.03,speed*0.03)
            script += ur.popup_stop("release", "release after next put")
            
        else:
            script += ur.popup_stop("move to original real", "release after next put")
            script += ur.move_l_compas(frame_t,accel*0.03,speed*0.03)
            script += ur.sleep(1)
            
            
        script += ur.set_digital_out(IO, False)
        script += ur.sleep(1)
        script += ur.move_l_compas(part.attributes["approach_hold_frame_real"],accel*0.1,speed*0.1)
        
    elif traj_name == "freespace_trajectory" or traj_name == "freespace_trajectory_after":
        for i in range(length):
            config = traj.points[i].joint_values
            script += ur.move_j_blend(config, accel, speed,0, blendradius)

#        config = traj.points[-1].joint_values
#        #nowait = False
#        script += ur.move_j_blend(config, accel, speed,0, blendradius)

#print pick_frame
script = c.concatenate_script(script)
if send:
    c.send_script(script,"192.168.10.12")



print("Finished.")
# ---------- end motion_planning_6 ----------

geo_5 = Geometry(motion_planning_6.frame_rhino_4)
geo_6 = Geometry(motion_planning_6.frame_rhino_2)
geo_7 = Geometry(motion_planning_6.frame_rhino_1)
deplane = DeconstructPlane(Plane=geo_7)  # -> Origin, XAxis, YAxis, ZAxis
panel_14 = Panel(motion_planning_5.script)
panel_15 = Panel(motion_planning_6.script)
multiplication_3 = Multiplication(A=deplane.ZAxis, B=Slider(-0.078, range=-0.1..0))
move_7 = Move(Geometry=geo_7, Motion=multiplication_3)  # -> Geometry, Transform
load_2 = GhPythonScript(assembly=motion_planning_4.assembly, robot=robot_2, reload=Button())  # -> robot, assembly; same code as load
load_plans_2 = GhPythonScript(assembly=load_2.assembly, part=subtraction_3, i=Slider(1, range=0..100))  # -> total, config, acms
# ---------- load_plans_2: Python ----------
trajectory_keys = ("freespace_trajectory",
                   "hold_trajectory",
                   "hold_trajectory_after",
                   "freespace_trajectory_after",)
trajectory_keys = (
                   "hold_trajectory",
                   "hold_trajectory_after",
)
# NOTE: Replace this with assembly.find_by_key after this is merged:
# https://github.com/compas-dev/compas/pull/1032
part = assembly.graph.node_attribute(str(int(part)), "part")

lbound = 0
ubound = 0
i = int(i)
total = sum([len(part.attributes[traj_name].points) for traj_name in trajectory_keys])
if i >= total:
    raise Exception('Max number of trajectory points is ' + str(total))
    
for traj_name in trajectory_keys:
    traj = part.attributes[traj_name]
    ubound += len(traj.points)

    if i >= ubound:
        lbound = ubound
        continue

    config = traj.points[i - lbound]
    acms = traj.attached_collision_meshes
    break
# ---------- end load_plans_2 ----------
robot_visualize_2 = RobotVisualize(
    robot=load_2.robot,
    configuration=load_plans_2.config,
    attached_collision_meshes=load_plans_2.acms,
    show_frames=True,
    show_acm=True)  # -> visual, collision, attached_meshes, frames, base_frame, ee_frame; inputs attached_collision_meshes: list, show_visual: Boolean, show_collision: Boolean, show_frames: Boolean, show_base_frame: Boolean, show_end_effector_frame: Boolean, show_acm: Boolean; same code as robot_visualize
built_assembly_2 = GhPythonScript(assembly=load_2.assembly, current_part=subtraction_3, only_until_current=Toggle(True))  # -> a; same code as built_assembly
planning_scene_2 = GhPythonScript(robot=load_2.robot, refresh=refresh_2)  # -> a; same code as planning_scene
ros_endfector_2 = Geometry(robot_visualize_2.attached_meshes)
ros_robot_2 = Geometry(robot_visualize_2.visual)
geo_8 = Geometry(built_assembly_2)
ros_geometry_2 = Geometry([ros_robot_2, ros_endfector_2])
rotate_10 = Rotate(Geometry=ros_geometry_2, Angle=degrees(Slider(180, range=0..1000)), Plane=PlaneXY(0, 0, 0))  # -> Geometry, Transform
reality_geometry = Geometry(rotate_9.Geometry)
reality_geometry_2 = Geometry(rotate_10.Geometry)
pl_3pt_3 = Plane3Pt(PointA=pt_34, PointB=pt_22, PointC=pt_32)
pl_3pt_4 = Plane3Pt(PointA=pt_24, PointB=pt_28, PointC=pt_21)
pl_3pt_5 = Plane3Pt(PointA=pt_34, PointB=pt_22, PointC=pt_32)
pl_3pt_6 = Plane3Pt(PointA=pt_24, PointB=pt_28, PointC=pt_21)
orient_4 = Orient(Geometry=ros_geometry_2, Source=pl_3pt_4, Target=pl_3pt_3)  # -> Geometry, Transform
orient_5 = Orient(Geometry=reality_geometry_2, Source=pl_3pt_6, Target=pl_3pt_5)  # -> Geometry, Transform
reality_geometry_robot_b = Geometry(orient_5.Geometry)
ros_geometry_robot_b = Geometry(orient_4.Geometry)

# ----
# Change-basis transformation
cob = GhPythonScript(F1=py_3, F2=py_2)  # -> T
# ---------- cob: Python ----------
from compas.geometry import Transformation

# change-basis transformation between two frames F1 and F2.
T = Transformation.from_change_of_basis(F1, F2)
# ---------- end cob ----------

py_6 = GhPythonScript(point=py, T=cob)  # -> a, point_transformed
# ---------- py_6: Python ----------
import Rhino.Geometry as rg
point_transformed = point.transformed(T)

a = rg.Point3d(point_transformed.x,point_transformed.y,point_transformed.z)
# ---------- end py_6 ----------
draw = GhPythonScript(frames=[py_2, py_3], scale=Slider(0.1, range=0..1))  # -> P, V, C, W; inputs frames: list
# ---------- draw: Python ----------
from System.Drawing import Color
from compas_ghpython.utilities import draw_frame

red = Color.FromArgb(255, 0, 0)
green = Color.FromArgb(0, 255, 0)
blue = Color.FromArgb(0, 0, 255)

P = []
V = []
C = []

scale = float(scale)

for frame in frames:
    if not frame:
        continue
    plane = draw_frame(frame)
    P += [plane.Origin] * 3
    V.append(plane.XAxis * scale)
    V.append(plane.YAxis * scale)
    V.append(plane.ZAxis * scale)
    C += [red, green, blue]

W = 3
# ---------- end draw ----------
vdisex = VectorDisplayEx(Point=draw.P, Vector=draw.V, Colour=draw.C, Width=draw.W)

py_7 = GhPythonScript(F2=py_2, point_transformed=py_6.point_transformed)  # -> A, V
# ---------- py_7: Python ----------
from compas.artists import Artist
import Rhino.Geometry as rg

x, y, z = point_transformed

A = []
V = []
A.append(F2.point)
V.append(F2.xaxis * x)
A.append(A[-1] + V[-1])
V.append(F2.yaxis * y)
A.append(A[-1] + V[-1])
V.append(F2.zaxis * z)

# display
A = [Artist(p).draw() for p in A]
V = [rg.Vector3d(*list(v)) for v in V]
# ---------- end py_7 ----------
vdis_2 = VectorDisplay(Anchor=py_7.A, Vector=py_7.V)

# ----
# 1. Calibrate the robot
number_slider_6 = Slider(4, range=0..10)
merge = Merge()
series_2 = Series(Start=0, Step=1, Count=number_slider_6)
shift = ShiftList(List=merge, Shift=graft(series_2), Wrap=True)  # -> simplify(List)
item_2 = ListItem(List=shift, Index=0, Wrap=True)  # -> Item, Item1, Item2
item_3 = ListItem(List=flatten(item_2.Item), Index=0, Wrap=True)
vec2pt = Vector2Pt(PointA=item_2.Item, PointB=item_2.Item2, Unitize=False)  # -> Vector, Length
vec2pt_2 = Vector2Pt(PointA=item_2.Item, PointB=item_2.Item1, Unitize=False)  # -> Vector, Length
pl_4 = ConstructPlane(Origin=item_3, XAxis=vec2pt_2.Vector, YAxis=vec2pt.Vector)  # -> flatten(Plane)
devec = DeconstructVector(Vector=pl_4)  # -> XComponent, YComponent, ZComponent
larger = LargerThan(FirstNumber=devec.ZComponent, SecondNumber="0")  # -> LargerThan, OrEqualTo
sift = SiftPattern(List=pl_4, SiftPattern=larger.LargerThan)  # -> Output0, Output1
panel_16 = Panel(sift.Output0)
flip_plane = FlipPlane(Plane=sift.Output0)
flip_plane_2 = FlipPlane(Plane=sift.Output0, ReverseX=False, ReverseY=False, SwapAxes=True)
combine = CombineData(Input0=flip_plane_2, Input1=sift.Output1)  # -> Result, Index
avrpln = AveragePlane(Planes=combine.Result)
deplane_2 = DeconstructPlane(Plane=avrpln)  # -> Origin, XAxis, YAxis, ZAxis
project = Project(Geometry=deplane_2.XAxis, Plane=PlaneXY(0, 0, 0))  # -> Geometry, Transform
X = UnitX(Factor=1)
angle = Angle(VectorA=project.Geometry, VectorB=X)  # -> Angle, Reflex
rotate_11 = Rotate(Geometry=avrpln, Angle=angle.Angle, Plane=avrpln)  # -> Geometry, Transform
number_slider_7 = Slider(200, range=0..1000)
deplane_3 = DeconstructPlane(Plane=rotate_11.Geometry)  # -> Origin, XAxis, YAxis, ZAxis
plnaxis_2 = PlaneAxis(P=rotate_11.Geometry, B=35)
multiplication_4 = Multiplication(A=deplane_3.XAxis, B=number_slider_7)
multiplication_5 = Multiplication(A=deplane_3.YAxis, B=number_slider_7)
move_8 = Move(Geometry=deplane_3.Origin, Motion=multiplication_5)  # -> Geometry, Transform
move_9 = Move(Geometry=deplane_3.Origin, Motion=multiplication_4)  # -> Geometry, Transform
pt_39 = Point(deplane_3.Origin)
toggle_5 = BooleanToggle(True)

pt_40 = Point(move_8.Geometry)
pt_41 = Point()

pt_42 = Point(move_9.Geometry)
pt_43 = Point()

pt_44 = Point()
pt_45 = Point(pt_39)

# ---- group: Select Target Pt
# Here you can select which point sent to UR
list = ValueList({"Ori_Pt": 0, "xAxis_Pt": 1, "yAxis_Pt": 2, "Safe_Pt": 3}, selected="Ori_Pt")
filter = StreamFilter(Gate=list, Stream0=pt_44, Stream1=pt_43, Stream2=pt_41)

# ---- group: Send to calibrate table
tcp_h = Slider(0, range=0..300)
send_tcp = Button()
send = Button()
conplane = GhPythonScript(pt=filter)  # -> plane; inputs pt: Point3d
# ---------- conplane: Python ----------
import Rhino.Geometry as rg

plane = rg.Plane(pt, rg.Vector3d.XAxis, rg.Vector3d.YAxis)
# ---------- end conplane ----------
sendtopoint = GhPythonScript(target_plane=conplane, tcp_height=tcp_h, send_TCP=send_tcp, send=send)  # -> rhino_base_way_planes, robot_planes, target_plane, script; inputs target_plane: Plane, send_TCP: Boolean
# ---------- sendtopoint: Python ----------
from compas_rhino import unload_modules
unload_modules('simple_ur_script')
unload_modules('simple_comm')

import simple_comm as c
import simple_ur_script as ur
import Rhino.Geometry as rg
import math as m

if send_TCP:
    script = ""
    script += ur.set_tcp_by_angles(float(-17.90), float(45.85), float(143.68), m.radians(0.0), m.radians(180.0), m.radians(90.0))
    script = c.concatenate_script(script)
    c.send_script(script,"192.168.10.10")

T = rg.Transform.Translation(0,0,tcp_height)
target_plane.Transform(T)

if send:
    script = ""
    script += ur.set_tcp_by_angles(float(-17.90), float(45.85), float(143.68), m.radians(0.0), m.radians(180.0), m.radians(90.0))
    velocity = 0.05
    acceleration = 0.02
    
    script += ur.move_l(target_plane, acceleration, velocity)
    script = c.concatenate_script(script)
    c.send_script(script,"192.168.10.10")
# ---------- end sendtopoint ----------

# ----
vec2pt_3 = Vector2Pt(PointA=pt_44, PointB=pt_41, Unitize=False)  # -> Vector, Length
vec2pt_4 = Vector2Pt(PointA=pt_44, PointB=pt_43, Unitize=False)  # -> Vector, Length
pl_5 = ConstructPlane(Origin=pt_44, XAxis=vec2pt_4.Vector, YAxis=vec2pt_3.Vector)
panel_17 = Panel(sendtopoint.script)

# ==== cluster PlaneAxis: show plane X Y Z axis.
P = ClusterInput()
B = ClusterInput()
deplane = DeconstructPlane(Plane=graft(P))  # -> Origin, XAxis, YAxis, ZAxis
multiplication = Multiplication(A=[deplane.XAxis, deplane.YAxis, deplane.ZAxis], B=B)
vdisex = VectorDisplayEx(
    Point=deplane.Origin,
    Vector=multiplication,
    Colour=[ColourSwatch(SwatchColor=RGB(235, 52, 52)), ColourSwatch(SwatchColor=RGB(90, 207, 48)), ColourSwatch(SwatchColor=RGB(54, 126, 227))],
    Width=2)

# ==== cluster Robot_Base
reference_plane = ClusterInput()
robot_base = Geometry([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])
item = ListItem(List=robot_base, Index=0, Wrap=True)
debrep = DeconstructBrep(Brep=item)  # -> Faces, Edges, Vertices
area = Area(Geometry=debrep.Faces)  # -> Area, Centroid
pdecon = Deconstruct(Point=area.Centroid)  # -> XComponent, YComponent, ZComponent
sort = SortList(Keys=pdecon.ZComponent, ValuesA=debrep.Faces, ValuesB=area.Centroid)  # -> Keys, reverse(ValuesA), reverse(ValuesB)
item_2 = ListItem(List=sort.ValuesA, Index=0, Wrap=True)
item_3 = ListItem(List=sort.ValuesB, Index=0, Wrap=True)
debrep_2 = DeconstructBrep(Brep=item_2)  # -> Faces, Edges, Vertices
item_4 = ListItem(List=debrep_2.Vertices, Index=0, Wrap=True)  # -> Item, Item1
vec2pt = Vector2Pt(PointA=item_3, PointB=[item_4.Item, item_4.Item1], Unitize=False)  # -> Vector, Length
item_5 = ListItem(List=vec2pt.Vector, Index=0, Wrap=True)  # -> Item, Item1
vec2pt_2 = Vector2Pt(PointA=reference_plane, PointB=item_3, Unitize=False)  # -> Vector, Length
move = Move(Geometry=reference_plane, Motion=vec2pt_2.Vector)  # -> Geometry, Transform
pl = ConstructPlane(Origin=item_3, XAxis=item_5.Item1, YAxis=item_5.Item)
align = AlignPlanes(Planes=pl, Master=move.Geometry)
orient = Orient(Geometry=robot_base, Source=align, Target=move.Geometry)  # -> Geometry, Transform
G = ClusterOutput(orient.Geometry)
